# Grasshopper definition Process Path Planning.gh (Grasshopper 1.0.7)

reload_process_from_disk = Button()
process_path = GhPythonScript()  # -> path
# ---------- process_path: Python ----------
from Rhino.RhinoDoc import ActiveDoc
import os
path = os.path.splitext(ActiveDoc.Path)[0] + "_process.json"
print path
# ---------- end process_path ----------
file_path = FilePath(process_path)
json_unpickle = GhPythonScript(path=file_path, enable=True, reload=reload_process_from_disk)  # -> warn_col, warn_msg, data; inputs enable: Boolean
# ---------- json_unpickle: Python ----------
import jsonpickle
import os
import datetime
if enable and not reload:
    exist = os.path.exists(path)
    if exist:
        with open(path, 'r') as f:
            data = jsonpickle.decode(f.read(), keys=True)
        c_time = datetime.datetime.fromtimestamp(os.path.getmtime(path))
        warn_col = "lime"
        warn_msg = "Process File loaded with %s Beams, %s Clamps, %s Grippers.\n File Modified on %s." % (len(list(data.assembly.beams())), len(list(data.clamps)), len(list(data.grippers)), c_time)
    else:
        warn_col = "orange"    
        warn_msg = "Process File not created yet"
# ---------- end json_unpickle ----------
legend = Legend(Colour=json_unpickle.warn_col, Tags=json_unpickle.warn_msg, LegendType=2)
process = Data(json_unpickle.data)

# ----
# Reload Python Modules (if Module Code is Changed)
python_module_to_reload = Panel("""compas
compas_fab
roslibpy
integral_timber_joints
clamp_controller""")
# Development Tools
reload = Button()
py = PythonScript(reload_module_button=reload, module_names=python_module_to_reload)  # inputs module_names: list
# ---------- py: Python ----------
import compas_ghpython
from compas_ghpython import unload_modules
if reload_module_button:
    for module in module_names:
        unload_modules(module)
# ---------- end py ----------

# ----
# Check Path and Environment
compas_version = GhPythonScript()  # -> out, compas_version, compas_fab_version, compas_path, compas_fab_path, compas_env_name, python_directory
# ---------- compas_version: Python ----------
__author__ = "leungp"
__version__ = "2020.04.20"

import rhinoscriptsyntax as rs
import compas
import compas_fab
compas_version  = compas.__version__
compas_fab_version = compas_fab.__version__
import os
compas_path = os.path.abspath(compas.__file__)
compas_fab_path = os.path.abspath(compas_fab.__file__)

import compas_bootstrapper
compas_env_name = compas_bootstrapper.ENVIRONMENT_NAME
python_directory = compas_bootstrapper.PYTHON_DIRECTORY
# ---------- end compas_version ----------
compas_environment_name = Panel(compas_version.compas_env_name)
compas_version_2 = Panel(compas_version.compas_version)
compas_fab_version = Panel(compas_version.compas_fab_version)
compas_path = Panel(compas_version.compas_path)
compas_fab_path = Panel(compas_version.compas_fab_path)
python_directory = Panel(compas_version.python_directory)

# ----
# Connect to MoveIt via ROS and load Robot
panel = Panel("192.168.0.117")
units = ValueList({"m": 1, "cm": 100, "mm": 1000}, selected="mm")
restart = Button()
load = Button()
ros = PythonScript(ip=panel, restart=restart)  # -> out, ros_client
# ---------- ros: Python ----------
import sys
import time
import scriptcontext as sc

from compas_fab.backends import RosClient

from System import TimeSpan
from System.Threading import ManualResetEventSlim


key = 'rosclient_%s' % str(ghenv.Component.InstanceGuid)
previous_client = sc.sticky.get(key, None)
if previous_client:
    previous_client.terminate()

ros_client = RosClient(ip, 9090)
sc.sticky[key] = ros_client

waitLock = ManualResetEventSlim(False)

ros_client.on_ready(lambda: waitLock.Set())

if not waitLock.Wait(TimeSpan.FromSeconds(5)):
    raise Exception('Unable to connect to ROS')


print "ROS is connected:", ros_client.is_connected
# ---------- end ros ----------
robot = PythonScript(client=ros.ros_client, unit=units, load=load)  # -> robot; inputs load: Boolean
# ---------- robot: Python ----------
from compas_fab.ghpython import RobotArtist

robot = client.load_robot(load_geometry=True,
                          urdf_param_name='/robot_description',
                          srdf_param_name='/robot_description_semantic',
                          precision=None,
                          local_cache_directory=None)

robot.scale(unit)
robot.artist = RobotArtist(robot.model)

print robot.info()
# ---------- end robot ----------
robot_2 = Data(robot)

# ----
# Planning group
panel_2 = Panel("robot12_eaYZ")

# ----
# Robot Joint Constraint (Path)
panel_3 = Panel("""robot12_joint_1
robot12_joint_2
robot12_joint_3
robot12_joint_4
robot12_joint_5
robot12_joint_6""")
panel_4 = Panel("""-179 to 179
-90 to 150
-180 to 75
-181 to 181
-100 to 100
-181 to 181""")
jointconstraint = GhPythonScript(joint_name=panel_3, limit_deg=panel_4)  # -> out, joint_constraint
# ---------- jointconstraint: Python ----------
from compas_fab.robots import JointConstraint
from math import radians

value = radians((limit_deg[1] + limit_deg[0]) / 2)
tolerance_above = radians(limit_deg[1]) - value
tolerance_below = value - radians(limit_deg[0])

# JointConstraint(joint_name, value, tolerance_above=0., tolerance_below=0., weight=1.)
joint_constraint = JointConstraint(joint_name, value, tolerance_above, tolerance_below, 1.0)

print value
print tolerance_above
print tolerance_below
# ---------- end jointconstraint ----------

group = Data(panel_2)
panel_5 = Panel(ros.out)
python = GhPythonScript(x=group)  # -> out, a
# ---------- python: Python ----------
if not x:
    print 1
# ---------- end python ----------

# ----
# Select Path to Plan
beam_sequence_number = Slider(2, range=1..40)
# Paths to be planned: Pickup To Begining of Linear Moves (Free - MoveAbsJ)
#  fm: 'assembly_wcf_storage'
#  to: 'assembly_wcf_inclampapproach'
# 
# Place into clamp (Linear - MoveL)
#  fm: 'assembly_wcf_inclampapproach'
#  to: 'assembly_wcf_inclamp'
# 
# Clamp Pre Closure (240 to 220mm)
# 
# Joint Assembly clamp (Linear - MoveL)
# 'assembly_wcf_inclamp'		-> 'assembly_wcf_final'		(Robot Clamp Sync Move)
# 'assembly_wcf_final'		-> 'assembly_wcf_finalretract'
# 
# 
# Retract Back To Pickup (Free - MoveAbsJ)
#  fm: 'assembly_wcf_finalretract'
#  to: 'assembly_wcf_storage'
list = ValueList({"Transfer Move To InclampApproach": 0, "Transit Move To Pickup": 1, "To Final"}, selected="Transfer Move To InclampApproach")

process_2 = Data(process)

# ----
# Load RFL robot for execution
get_robot_frame = Button()
init_robot = Button()
ghpython_script = GhPythonScript(ros_client=ros.ros_client, init_robot=init_robot)  # -> robot_11, robot_12, robots; inputs init_robot: Boolean
# ---------- ghpython_script: Python ----------
from compas_rrc import *

if ros_client:
    robot_11 = AbbClient(ros_client, "/robot_1")
    robot_12 = AbbClient(ros_client, "/robot_2")
    
    robots = (robot_11, robot_12, None, None)
# ---------- end ghpython_script ----------
ghpython_script_2 = GhPythonScript(get_robot_frame=get_robot_frame, robot=ghpython_script.robot_12)  # -> plane; inputs get_robot_frame: Boolean
# ---------- ghpython_script_2: Python ----------
from scriptcontext import sticky as st
from compas_rrc import *
from compas_ghpython import draw_frame



# output sticky
guid = str(ghenv.Component.InstanceGuid)
response_key_frame = "robot_frame_" + guid
if response_key_frame not in st:
    st[response_key_frame] = None



if get_robot_frame:
    
    
    # get current robot pose
    robot.send(SetWorkObject('wobj0'))
    robot.send(SetTool('tool0'))
    
    #robot.send(SetWorkObject('wobj0'))
    #robot.send(SetTool('tool0'))
    
    robot_current_robtarget = robot.send_and_wait(GetRobtarget(), timeout=10)

    robot_current_frame = robot_current_robtarget[0]
    robot_current_external_exes = robot_current_robtarget[1]
    
    st[response_key_frame] = robot_current_frame



plane = draw_frame(st[response_key_frame])
# ---------- end ghpython_script_2 ----------
data = Data(ghpython_script_2)

init_robot_2 = Button()

# ----
# Select Beam to plan
process_3 = Data(process_2)
python_2 = GhPythonScript(process=process_3)  # -> out, beam_ids, beam_seq_ids
# ---------- python_2: Python ----------
beam_ids = [b for b in process.assembly.sequence]
beam_seq_ids = ["S%i"%(i+1) for i in range(len(process.assembly.sequence))]
# ---------- end python_2 ----------
item = ListItem(List=python_2.beam_ids, Index=expr("x-1", beam_sequence_number), Wrap=True)
item_2 = ListItem(List=python_2.beam_seq_ids, Index=expr("x-1", beam_sequence_number), Wrap=True)
sequence_number = Panel(item_2)
beam_id = Panel(item)

python_3 = GhPythonScript(ros_ip=panel, reload=init_robot_2)  # -> out, clamps_connection
# ---------- python_3: Python ----------
from clamp_controller.RemoteClampFunctionCall import RemoteClampFunctionCall

if not reload:
    clamps_connection = RemoteClampFunctionCall(ros_ip)
# ---------- end python_3 ----------
get_robot_frame_2 = Button()
hard = Button()
soft = Button()

# ----
# Beam Geometry - All Beams
swatch = ColourSwatch(SwatchColor=RGB(194, 194, 194))
all_beams = GhPythonScript(process=process_3, beam_color=swatch)  # -> beams; inputs beam_color: Color
# ---------- all_beams: Python ----------
__author__ = "leungp"
__version__ = "2020.02.19"

from compas_ghpython.helpers import mesh_draw
from compas.geometry import Transformation
from compas.datastructures import meshes_join

from Rhino.Geometry import Mesh as RhinoMesh
assembly = process.assembly

beams = []
for beam in process.assembly.beams():
    beams.append(mesh_draw(beam.cached_mesh, color = beam_color))
# ---------- end all_beams ----------
transform_design_to_robotworld = Transform({TransformCount=1, Name="Orientation", source.origin.x=-50, source.origin.y=850, source.origin.z=0, source.xaxis.x=0, source.xaxis.y=-1, source.xaxis.z=0, source.yaxis.x=1, source.yaxis.y=0, source.yaxis.z=0, target.origin.x=24991.934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})
transform = Transform(Geometry=all_beams, Transform=transform_design_to_robotworld)

ghpython_script_3 = GhPythonScript(get_robot_frame=get_robot_frame_2, robot=ghpython_script.robot_12)  # -> plane; inputs get_robot_frame: Boolean; same code as ghpython_script_2
make_robot_soft = GhPythonScript(robot=ghpython_script.robot_12, execute_soft=soft, execute_hard=hard)  # -> out
# ---------- make_robot_soft: Python ----------
import compas_rrc as rrc

if execute_soft:
    robot.send(rrc.CustomInstruction('r_A067_ActSoftServo'))
    robot_current_joints, robot_current_ext = robot.send_and_wait(rrc.GetJoints(), timeout=30)
    robot.send(rrc.MoveToJoints(robot_current_joints, robot_current_ext, 500, rrc.Zone.FINE))
    
if execute_hard:
    robot.send(rrc.CustomInstruction('r_A067_DeactSoftServo'))
# ---------- end make_robot_soft ----------

# ----
# Extracting Geo and Frames from Process
transform_design_to_robotworld_2 = Transform({TransformCount=1, Name="Orientation", source.origin.x=-50, source.origin.y=850, source.origin.z=0, source.xaxis.x=0, source.xaxis.y=-1, source.xaxis.z=0, source.yaxis.x=1, source.yaxis.y=0, source.yaxis.z=0, target.origin.x=24991.934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})
flange_pos_in_robworld = GhPythonScript(process=process_3, beam_id=item, robot_world_transform=transform_design_to_robotworld_2)  # -> out, assembly_wcf_inclampapproach, assembly_wcf_inclamp, assembly_wcf_final, assembly_wcf_finalretract; inputs robot_world_transform: Transform
# ---------- flange_pos_in_robworld: Python ----------
from compas.geometry import Frame, Transformation

from compas_ghpython import draw_frame
#from compas_ghpython.helpers import 

# Transformation from design_world to 


def transformation_from_xform(transformation):
    """Creates a Compas Transformation instance from a Rhino Transform
    """
    transform = Transformation()
    for i in range(0, 4):
        for j in range(0, 4):
            transform[i, j] = transformation[i, j]
    return transform

def flange_frame_at(process, beam_id, attribute_name, transformation = None):
    """ Returns the T0CP (robot flange) for the gripper at different location.
    The result takes into account the gripper (tool) and toolchanger (tool) offsets.
    
    Optional transformation can be supplied for transforming from design-world to Robot-world
    This function has a side effect changing the process.toolchanger and gripper 's current frame.
    """
    if process.get_gripper_t0cp_for_beam_at(beam_id, attribute_name) is None:
        return None  # Return None if the position doesn't exist

    assembly = process.assembly
    gripper_type = assembly.get_beam_attribute(beam_id, 'gripper_type')
    gripper = process.get_one_gripper_by_type(gripper_type)
    toolchanger = process.robot_toolchanger

    gripper_t0cp = process.get_gripper_t0cp_for_beam_at(beam_id, attribute_name)
    toolchanger.set_current_frame_from_tcp(gripper_t0cp)
    t0cp = toolchanger.current_frame.copy()
    # Post transformation
    if transformation is not None:
        t0cp.transform(transformation)
    return t0cp

if robot_world_transform is not None:
    robot_world_transform = transformation_from_xform(robot_world_transform)

if process.get_gripper_t0cp_for_beam_at(beam_id, 'assembly_wcf_inclampapproach'):
    assembly_wcf_inclampapproach =  draw_frame(flange_frame_at(process, beam_id, 'assembly_wcf_inclampapproach', robot_world_transform))
else:
    assembly_wcf_inclampapproach =  draw_frame(flange_frame_at(process, beam_id, 'assembly_wcf_inclamp', robot_world_transform))
assembly_wcf_inclamp =  draw_frame(flange_frame_at(process, beam_id, 'assembly_wcf_inclamp', robot_world_transform))
assembly_wcf_final =  draw_frame(flange_frame_at(process, beam_id, 'assembly_wcf_final', robot_world_transform))
assembly_wcf_finalretract =  draw_frame(flange_frame_at(process, beam_id, 'assembly_wcf_finalretract', robot_world_transform))
# ---------- end flange_pos_in_robworld ----------
visualize_beams = GhPythonScript(process=process_3, beam_id=item)  # -> out, previous_beams, current_beam_final, acm_origin_beam, acm_origin_tool_group, visual_origin_wrist, clamps_on_structure, clamp_types
# ---------- visualize_beams: Python ----------
__author__ = "leungp"
__version__ = "2020.02.19"

from compas_ghpython.helpers import mesh_draw
from compas.geometry import Transformation
from compas.datastructures import meshes_join

from Rhino.Geometry import Mesh as RhinoMesh
assembly = process.assembly

# If user has no selection, assume the last beam is picked.
if beam_id is None: beam_id = assembly.sequence[-1]

##########################
# Previous Beams
##########################

# Collect the previously-assembled beam(s)
previous_beams = []

for this_beam_id in assembly.get_already_built_beams(beam_id):
    beam = assembly.beam(this_beam_id)
    previous_beams.append(mesh_draw(beam.cached_mesh))

###################################
# Current Beam (Different Location)
###################################

# Select the current beam
beam = assembly.beam(beam_id)

# Translate the beam to various location and display
current_beam = []
current_beam_assembly_wcf_final = mesh_draw(beam.cached_mesh)

def join_meshes(meshes):
    if len(meshes) == 1 : return meshes [0]
    

def beam_mesh_at(attribute_name):
    T = assembly.get_beam_transformaion_to(beam_id, attribute_name)
    if T is not None:
        return (mesh_draw(beam.cached_mesh.transformed(T)))
    else: return None

current_beam_storage = beam_mesh_at('assembly_wcf_storage')
current_beam_final = beam_mesh_at('assembly_wcf_final')
###################################
# Clamps (multiple clamps)
###################################

clamps_on_structure = []
clamp_types = []
# Visualize clamps
for neighbour_id in assembly.get_already_built_neighbors(beam_id):
    joint_id = (neighbour_id, beam_id)
    clamp_wcf_final = assembly.get_joint_attribute(joint_id, 'clamp_wcf_final')
    clamp_type = assembly.get_joint_attribute(joint_id, 'clamp_type')
    clamp = process.get_one_clamp_by_type(clamp_type).copy()
    clamp.current_frame = clamp_wcf_final
    clamp.clamp_jaw_position = 120
    clamp.gripper_jaw_position = 0
    clamps_on_structure += [mesh_draw(m) for m in clamp.draw_visuals()]
    print ("Clamps needed at " , joint_id, clamp.type_name)
    clamp_types.append(clamp.type_name)
    

###################################
# Gripper (At Origin for ACM)
###################################

from compas.geometry import Frame
# Tool changer (At Origin)
toolchanger = process.robot_toolchanger
toolchanger.current_frame = Frame.worldXY()
acm_origin_tool_group =  [mesh_draw(m) for m in toolchanger.draw_visuals()]

# Gripper (At Tool Changer)
gripper_type = assembly.get_beam_attribute(beam_id, 'gripper_type')
gripper = process.get_one_gripper_by_type(gripper_type)
gripper.current_frame = process.robot_toolchanger.tool_coordinate_frame.copy()
acm_origin_tool_group +=  [mesh_draw(m) for m in gripper.draw_visuals()]

# Beam (In Gripper)
gripper_t0cp = process.get_gripper_t0cp_for_beam_at(beam_id, 'assembly_wcf_final')
T = Transformation.from_frame_to_frame(gripper_t0cp, gripper.current_frame.copy())
acm_origin_beam = [mesh_draw(beam.cached_mesh.transformed(T))]

###################################
# Gripper (Different Location)
###################################

gripper = []
# Get Gripper and move it to the beam's frame
gripper_type = assembly.get_beam_attribute(beam_id, 'gripper_type')
_gripper = process.get_one_gripper_by_type(gripper_type)

#gripper_tcp_in_ocf = assembly.get_beam_attribute(beam_id, "gripper_tcp_in_ocf")
#gripper_tcp_in_wcf = gripper_tcp_in_ocf.transformed(Transformation.from_frame(beam.frame))

def draw_gripper_at(attribute_name, gripper_open = True):
    gripper_t0cp = process.get_gripper_t0cp_for_beam_at(beam_id, attribute_name)
    if gripper_t0cp is not None:
        _gripper.current_frame = gripper_t0cp
        if gripper_open: _gripper.open_gripper()
        else: _gripper.close_gripper()
        
        process.robot_toolchanger.set_current_frame_from_tcp(gripper_t0cp)

        meshes = meshes_join(_gripper.draw_visuals() + process.robot_toolchanger.draw_visuals())
        gripper.append(mesh_draw(meshes,  color = gripper_color))
        
    else: gripper.append(None)

visual_origin_wrist = mesh_draw(process.robot_wrist_collision_mesh)


#
#draw_beam_at('assembly_wcf_storage') # Beam does not go to 'assembly_wcf_storageapproach'
#draw_gripper_at('assembly_wcf_storageapproach', True)
#
#
#draw_beam_at('assembly_wcf_storage')
#draw_beam_at('assembly_wcf_storageretract')
#if assembly.get_beam_attribute(beam_id, 'assembly_wcf_inclampapproach') is not None:
#    draw_beam_at('assembly_wcf_inclampapproach')
#else:
#    draw_beam_at('assembly_wcf_inclamp')
#draw_beam_at('assembly_wcf_inclamp')
#draw_beam_at('assembly_wcf_final')
#draw_beam_at('assembly_wcf_final') # Beam does not go to 'assembly_wcf_finalretract'
#
#
#
#
#draw_gripper_at('assembly_wcf_storage', True)
#draw_gripper_at('assembly_wcf_storageretract', False)
#if assembly.get_beam_attribute(beam_id, 'assembly_wcf_inclampapproach') is not None:
#    draw_gripper_at('assembly_wcf_inclampapproach', False)
#else:
#    draw_gripper_at('assembly_wcf_inclamp', False)
#draw_gripper_at('assembly_wcf_inclamp', False)
#draw_gripper_at('assembly_wcf_final', False)
#draw_gripper_at('assembly_wcf_finalretract', True)
#
# ---------- end visualize_beams ----------

assembly_wcf_inclamp = Plane(flange_pos_in_robworld.assembly_wcf_inclamp)
assembly_wcf_final = Plane(flange_pos_in_robworld.assembly_wcf_final)

# ----
# Check Current Robot Plane
get_robot_frame_3 = Button()
ghpython_script_4 = GhPythonScript(get_robot_frame=get_robot_frame_3, robot=ghpython_script.robot_12)  # -> plane; inputs get_robot_frame: Boolean; same code as ghpython_script_2
data_2 = Data(ghpython_script_4)
dist = Distance(PointA=data_2, PointB=assembly_wcf_final)
# Sending Rob-Clamp Sync Command
distance_to_final_plane = Panel(dist)

wobj0_tool0 = GhPythonScript(get_robot_frame=Button())  # -> plane; inputs get_robot_frame: Boolean; same code as ghpython_script_2
rec = DataRecorder(make_robot_soft, DataLimit=-10, RecordData=True)
data_3 = Data(ghpython_script_3)
pln = Plane(flange_pos_in_robworld.assembly_wcf_final)
visualize_beams_2 = GhPythonScript(process=process_3, beam_id=item)  # -> out, clamps_on_structure, clamps_frame, clamp_types, clamp_addresses
# ---------- visualize_beams_2: Python ----------
__author__ = "leungp"
__version__ = "2020.02.19"

from compas_ghpython.helpers import mesh_draw
from compas.geometry import Transformation
from compas.datastructures import meshes_join

from Rhino.Geometry import Mesh as RhinoMesh
from compas_ghpython import draw_frame

assembly = process.assembly

###################################
# Clamps (multiple clamps)
###################################
clamp_colours = { 'CL3' : [0,200,0], 'CL3M' : [0,0,200]}
available_clamp_addresses = { 'CL3' : ['1','2'], 'CL3M' : ['3','4']}

clamps_on_structure = []
clamp_types = []
clamp_addresses = []
clamps_frame = []
# Visualize clamps
for neighbour_id in assembly.get_already_built_neighbors(beam_id):
    joint_id = (neighbour_id, beam_id)
    clamp_wcf_final = assembly.get_joint_attribute(joint_id, 'clamp_wcf_final')
    clamp_type = assembly.get_joint_attribute(joint_id, 'clamp_type')
    clamp = process.get_one_clamp_by_type(clamp_type).copy()
    clamp.current_frame = clamp_wcf_final
    clamps_frame.append(draw_frame(clamp_wcf_final))
    clamp.clamp_jaw_position = 120
    clamp.gripper_jaw_position = 0
    clamps_on_structure += [mesh_draw(m, clamp_colours[clamp.type_name]) for m in clamp.draw_visuals()]
    neighbour_seq_id = 'S%i'% assembly.sequence.index(joint_id[0])
    clamp_address = available_clamp_addresses[clamp.type_name].pop(0)
    clamp_addresses.append(clamp_address)
    print ("Install Clamp %s (address %s) on Beam %s (Joint %s-%s)" % (clamp.type_name, clamp_address, neighbour_seq_id, joint_id[0], joint_id[1]))
    clamp_types.append(clamp.type_name)
# ---------- end visualize_beams_2 ----------
dist_2 = Distance(PointA=pln, PointB=data_3)
panel_6 = Panel(rec)
plane_read_from_wobj0_tool0 = Plane(wobj0_tool0)
# Static Collision - Clamps on Beam
transform_design_to_robotworld_3 = Transform({TransformCount=1, Name="Orientation", source.origin.x=-50, source.origin.y=850, source.origin.z=0, source.xaxis.x=0, source.xaxis.y=-1, source.xaxis.z=0, source.yaxis.x=1, source.yaxis.y=0, source.yaxis.z=0, target.origin.x=24991.934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})

dist_3 = Distance(PointA=flange_pos_in_robworld.assembly_wcf_inclampapproach, PointB=flange_pos_in_robworld.assembly_wcf_inclamp)
dist_4 = Distance(PointA=flange_pos_in_robworld.assembly_wcf_inclamp, PointB=flange_pos_in_robworld.assembly_wcf_final)
dist_5 = Distance(PointA=flange_pos_in_robworld.assembly_wcf_final, PointB=flange_pos_in_robworld.assembly_wcf_finalretract)
panel_7 = Panel(dist_3)
panel_8 = Panel(dist_5)
panel_9 = Panel(dist_4)

panel_10 = Panel(dist_2)
panel_11 = Panel("3")
vec2pt = Vector2Pt(PointA=flange_pos_in_robworld.assembly_wcf_inclamp, PointB=flange_pos_in_robworld.assembly_wcf_final, Unitize=False)  # -> Vector, Length
panel_12 = Panel(plane_read_from_wobj0_tool0)
send = Button()
panel_13 = Panel(visualize_beams_2.out)
transform_2 = Transform(Geometry=visualize_beams_2.clamps_frame, Transform=transform_design_to_robotworld_3)
panel_14 = Panel(vec2pt.Vector)
# Sending robot to pickup point
gantry_guy = Button()
cluster = Cluster(P=transform_2)
tag = TextTag3D(Location=cluster, Text=visualize_beams_2.clamp_types, Size=150, Colour=RGB(191, 191, 191), Justification=5)

# ----
# Attached Collision Mesh
unweld = UnweldMesh(Mesh=visualize_beams.acm_origin_beam, Angle=0.1)
attached_colision_mesh_at_origin_gripper = Geometry(visualize_beams.acm_origin_tool_group)  # "Attached Colision Mesh (at origin) - Gripper and Toolchanger"
attached_colision_mesh_at_origin_beam = Geometry(unweld)

# ----
# Visualization - Current Beam at final Pos
transform_design_to_robotworld_4 = Transform({TransformCount=1, Name="Orientation", source.origin.x=-50, source.origin.y=850, source.origin.z=0, source.xaxis.x=0, source.xaxis.y=-1, source.xaxis.z=0, source.yaxis.x=1, source.yaxis.y=0, source.yaxis.z=0, target.origin.x=24991.934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})
transform_3 = Transform(Geometry=visualize_beams.current_beam_final, Transform=transform_design_to_robotworld_4)
preview = CustomPreview(Geometry=transform_3, Shader=ColourSwatch(SwatchColor=RGBA(50, 166, 0, 23)))

# ----
# Static Collision - Already Built Beams
transform_design_to_robotworld_5 = Transform({TransformCount=1, Name="Orientation", source.origin.x=-50, source.origin.y=850, source.origin.z=0, source.xaxis.x=0, source.xaxis.y=-1, source.xaxis.z=0, source.yaxis.x=1, source.yaxis.y=0, source.yaxis.z=0, target.origin.x=24991.934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})
transform_4 = Transform(Geometry=visualize_beams.previous_beams, Transform=transform_design_to_robotworld_5)
preview_2 = CustomPreview(Geometry=transform_4, Shader=ColourSwatch(SwatchColor=RGB(166, 94, 0)))

# ----
# Visualization - Clamp on Structure
transform_design_to_robotworld_6 = Transform({TransformCount=1, Name="Orientation", source.origin.x=-50, source.origin.y=850, source.origin.z=0, source.xaxis.x=0, source.xaxis.y=-1, source.xaxis.z=0, source.yaxis.x=1, source.yaxis.y=0, source.yaxis.z=0, target.origin.x=24991.934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})
transform_5 = Transform(Geometry=visualize_beams.clamps_on_structure, Transform=transform_design_to_robotworld_6)
preview_3 = CustomPreview(Geometry=transform_5, Shader=ColourSwatch(SwatchColor=RGB(166, 94, 0)))

# ----
# Collision Meshes
# Static Collision - Environment Scene
collision_mesh_scene_static = Mesh([<mesh referenced from the Rhino model> x32])

panel_15 = Panel("""robot12_joint_1
robot12_joint_2
robot12_joint_3
robot12_joint_4
robot12_joint_5
robot12_joint_6
robot12_joint_EA_Y
robot12_joint_EA_Z""")
panel_16 = Panel("""robot12_joint_1
robot12_joint_2
robot12_joint_3
robot12_joint_4
robot12_joint_5
robot12_joint_6""")
send_2 = Button()
mjoin = MeshJoin(Meshes=flatten(collision_mesh_scene_static))

# ----
# Visualize Planned Motion
idx = Slider(0, range=0..1)
list_2 = ValueList({"Starting Config": 0, "Ending Config": 1, "Planned Path 1": 2, "Planned Path 2": 3, "New Planner": 4}, selected="New Planner")

robot11_movetorobtarget = GhPythonScript(send=send_2)  # -> out; inputs send: Boolean
# ---------- robot11_movetorobtarget: Python ----------
import compas.geometry as cg
from compas_rrc import *
from compas_ghpython import draw_frame



if send:
    

    
    speed = 50 #mm/s
    zone = Zone.FINE

    # Connect with iGPS Server
    string_values = ['Robot11']
    float_values = []
    feedback_level = 0
    robot.send(CustomInstruction('r_A042_iGPS_Connect', string_values, float_values, feedback_level=feedback_level))
    
    # Set Tool
#    robot.send(SetTool('igps_tool0'))
    
    # Set Work Object
#    robot.send(SetWorkObject('igps_wobj0'))
    
    # Set iGPS tool
    robot.send(CustomInstruction('r_A042_iGPS_SetTool', ['tool0'], [], feedback_level=0))
    robot.send(CustomInstruction('r_A042_SetTool', ['igps_tool0'], [], feedback_level=0))
    
    # Set iGPS work object
    robot.send(CustomInstruction('r_A042_iGPS_SetWobj', ['wobj0'], [], feedback_level=0))
    robot.send(CustomInstruction('r_A042_SetWobj', ['igps_wobj0'], [], feedback_level=0))
    
    
    
    # Get frame
    frame, external_axes = robot.send_and_wait(GetRobtarget(), timeout=10)
    print('GetRobtarget Result = ', frame.point, frame.quaternion , external_axes)
    
    # iGPS move and correct
    # Note that r_A042_iGPS_MoveL only works with igps_tool0.
    
    
    string_values = []
    float_values = list(frame.point) + list(frame.quaternion) + list(external_axes) + [50.0] + [Zone.FINE]
    feedback_level = 1
    done = robot.send_and_wait(CustomInstruction('r_A042_iGPS_MoveL', string_values, float_values, feedback_level=feedback_level), timeout=60)

    # Get frame
    frame, external_axes = robot.send_and_wait(GetRobtarget(), timeout=10)
    print('GetRobtarget Result = ', frame.point, frame.quaternion , external_axes)
    


import compas.geometry as cg
from compas_rrc import *
from compas_ghpython import draw_frame

from compas_rhino.geometry import RhinoPlane
target_frame = RhinoPlane.from_geometry(target_plane).to_compas()

if send:
    
    
    
    # send correction
    robot.send(SetWorkObject('wobj0'))
    robot.send(SetTool('tool0'))
    
    
    robot_current_robtarget = robot.send_and_wait(GetRobtarget(), timeout=1)
    robot_current_external_exes = robot_current_robtarget[1]
    
    
    speed = 50 #mm/s
    zone = Zone.FINE

#    robot.send_and_wait(MoveToRobtarget(target_frame, robot_current_external_exes, speed, zone, motion_type=Motion.LINEAR), timeout=1)
    robot.send(MoveToRobtarget(target_frame, robot_current_external_exes, speed, zone, motion_type=Motion.LINEAR))
# ---------- end robot11_movetorobtarget ----------

# ----
# Select Path to Plan
list_3 = ValueList({"Transfer Move To InclampApproach": 0, "Transit Move To Pickup": 1, "To Final"}, selected="Transfer Move To InclampApproach")
beam_sequence_number_2 = Slider(2, range=1..40)
item_3 = ListItem(List=python_2.beam_ids, Index=expr("x-1", beam_sequence_number_2), Wrap=True)
item_4 = ListItem(List=python_2.beam_seq_ids, Index=expr("x-1", beam_sequence_number_2), Wrap=True)
sequence_number_2 = Panel(item_4)
beam_id_2 = Panel(item_3)

allowed_planning_time = Slider(10, range=0..10)

clear_previously_saved_trajectory = Button()
plan_motion = Button()

clear_previously_saved_trajectory_2 = Button()
plan_motion_2 = Button()

python_4 = PythonScript(
    robot=robot_2,
    group=group,
    goal_plane=flange_pos_in_robworld.assembly_wcf_inclampapproach,
    tolerance_position=0.001,
    tolerance_xaxis_deg=1,
    tolerance_yaxis_deg=1,
    tolerance_zaxis_deg=1)  # -> goal_constraints
# ---------- python_4: Python ----------
import math
from compas.geometry import Frame

frame = Frame(goal_plane.Origin, goal_plane.XAxis, goal_plane.YAxis)

tolerances_axes = [math.radians(tolerance_xaxis_deg), math.radians(tolerance_yaxis_deg), math.radians(tolerance_zaxis_deg)]

if robot:
    goal_constraints = robot.constraints_from_frame(frame, tolerance_position, tolerances_axes, group)
# ---------- end python_4 ----------

# ----
# Attached CM (joinned to single mesh)
merge = Merge(Data1=attached_colision_mesh_at_origin_beam, Data2=attached_colision_mesh_at_origin_gripper)
mjoin_2 = MeshJoin(Meshes=merge)
mesh = PythonScript(mesh=mjoin_2)  # -> compas_mesh, acm
# ---------- mesh: Python ----------
from compas.datastructures import Mesh
from compas_rhino.geometry import RhinoMesh

compas_mesh = RhinoMesh.from_geometry(mesh).to_compas()
# ---------- end mesh ----------
acm_compas_mesh = Data(mesh.compas_mesh)
acm_rhino_mesh = Mesh(mjoin_2)

# ----
# Visualize - Attached CM at target
orient = Orient(Geometry=acm_rhino_mesh, Source=PlaneXY(0, 0, 0), Target=flange_pos_in_robworld.assembly_wcf_inclamp)  # -> Geometry, Transform
preview_4 = CustomPreview(Geometry=orient.Geometry, Shader=ColourSwatch(SwatchColor=RGBA(153, 255, 0, 0)))

# ----
# Static CM (joinned to single mesh)
merge_2 = Merge(Data1=collision_mesh_scene_static, Data2=transform_4, Data3=transform_5)
mjoin_3 = MeshJoin(Meshes=flatten(merge_2))
mesh_2 = PythonScript(mesh=mjoin_3)  # -> compas_mesh; inputs mesh: Mesh; same code as mesh
cm_compas_mesh = Data(mesh_2)
cm_rhino_mesh = Mesh(mjoin_3)

scene = PythonScript(robot=robot_2)  # -> scene
# ---------- scene: Python ----------
from scriptcontext import sticky as st

from compas_fab.robots import PlanningScene

# store scene in component
guid = str(ghenv.Component.InstanceGuid)
scene_key = "scene_" + guid

if scene_key not in st:
    st[scene_key] = None

if robot:
    st[scene_key] = PlanningScene(robot)

scene = st[scene_key]
# ---------- end scene ----------
python_5 = PythonScript(
    robot=robot_2,
    group=group,
    goal_plane=flange_pos_in_robworld.assembly_wcf_inclampapproach,
    tolerance_position=0.001,
    tolerance_xaxis_deg=0.1,
    tolerance_yaxis_deg=0.1,
    tolerance_zaxis_deg=0.1)  # -> goal_constraints; disabled; same code as python_4
force_goal_config = BooleanToggle(False)
plan_motion_3 = Button()
reverse = BooleanToggle(False)
# Planning scene
button = Button()

py_2 = PythonScript(robot=robot_2, group=group)  # -> ee_link_name, preee_link_name
# ---------- py_2: Python ----------
if robot:
    ee_link_name = robot.get_end_effector_link_name(group)
    preee_link_name = robot.get_end_effector_link(group).parent_joint.parent.link
# ---------- end py_2 ----------
panel_17 = Panel(py_2.preee_link_name)
panel_18 = Panel(py_2.ee_link_name)
set_attached_cm = PythonScript(
    scene=scene,
    compas_mesh=acm_compas_mesh,
    id="attached_cm",
    link_name=panel_18,
    touch_links=[panel_17, panel_18],
    set=Toggle(True))  # -> acm, out; inputs touch_links: list
# ---------- set_attached_cm: Python ----------
from compas_fab.robots import CollisionMesh
from compas_fab.robots import AttachedCollisionMesh
from compas.datastructures import Mesh
from copy import deepcopy

compas_mesh = deepcopy(compas_mesh)

cm = CollisionMesh(compas_mesh, id)
acm = AttachedCollisionMesh(cm, link_name, touch_links)

if scene and set:
    scene.add_attached_collision_mesh(acm, True)
# ---------- end set_attached_cm ----------

set_collision_mesh = PythonScript(scene=scene, compas_mesh=cm_compas_mesh, id="static_cm", set=Toggle(True))  # -> out
# ---------- set_collision_mesh: Python ----------
from compas_fab.robots import CollisionMesh
from copy import deepcopy
compas_mesh = deepcopy(compas_mesh)

if scene and set:
    cm = CollisionMesh(compas_mesh, id)
    scene.add_collision_mesh(cm, True)
# ---------- end set_collision_mesh ----------
panel_19 = Panel(set_collision_mesh)

reverse_2 = BooleanToggle(False)
allowed_planning_time_2 = Slider(2, range=0..10)

# ----
# Starting Configuration
gantry_x = Slider(25000, range=20500..25000)
# Starting Ganrty X value can be within 22500 to 24000
robot_11_yz_6joints = Panel("""-0
-4900
-90
-80
65
0
0
0""")
robot_12_yz_6joints = Panel("""-4056
-4000
0
-22.8
-30.7
0
57.3
0""")
temporary_pick_up_location = Plane(Plane(origin=(23238.19823, 4056.088379, 934.2950249), x=(-0.06608858708, 0, 0.9978137595), y=(0, -1, 0)))

merge_3 = Merge(Data1=flatten(gantry_x), Data2=flatten(robot_11_yz_6joints))  # -> flatten(Result)

python_script = PythonScript(robot11=merge_3, robot12=robot_12_yz_6joints)  # -> c; inputs robot11: list, robot12: list
# ---------- python_script: Python ----------
from compas_fab.robots import Configuration
from math import radians as rad


start_full_configuration = Configuration(
    values = (
        robot11[0],
        robot11[1], robot11[2],
        rad(robot11[3]), rad(robot11[4]), rad(robot11[5]), rad(robot11[6]), rad(robot11[7]), rad(robot11[8]),
        robot12[0], robot12[1],
        rad(robot12[2]), rad(robot12[3]), rad(robot12[4]), rad(robot12[5]), rad(robot12[6]), rad(robot12[7]),
        38000,
        0, -4915,
        0, 0, 0, 0, 0, 0,
        -12237, -4915,
        0, 0, 0, 0, 0, 0
        ),
    types = (
        2,
        2, 2,
        0, 0, 0, 0, 0, 0,
        2, 2,
        0, 0, 0, 0, 0, 0,
        2,
        2, 2,
        0, 0, 0, 0, 0, 0,
        2, 2,
        0, 0, 0, 0, 0, 0
        ),
    joint_names = (
        'bridge1_joint_EA_X',
        'robot11_joint_EA_Y', 'robot11_joint_EA_Z',
        'robot11_joint_1', 'robot11_joint_2', 'robot11_joint_3', 'robot11_joint_4', 'robot11_joint_5', 'robot11_joint_6',
        'robot12_joint_EA_Y', 'robot12_joint_EA_Z',
        'robot12_joint_1', 'robot12_joint_2', 'robot12_joint_3', 'robot12_joint_4', 'robot12_joint_5', 'robot12_joint_6',
        'bridge2_joint_EA_X',
        'robot21_joint_EA_Y', 'robot21_joint_EA_Z',
        'robot21_joint_1', 'robot21_joint_2', 'robot21_joint_3', 'robot21_joint_4', 'robot21_joint_5', 'robot21_joint_6',
        'robot22_joint_EA_Y', 'robot22_joint_EA_Z',
        'robot22_joint_1', 'robot22_joint_2', 'robot22_joint_3', 'robot22_joint_4', 'robot22_joint_5', 'robot22_joint_6'
        )
    )

c = start_full_configuration
# ---------- end python_script ----------
pickup_fconfig = Data(python_script)
python_6 = GhPythonScript(robot=robot_2, group=group, configuration=pickup_fconfig)  # -> out, ee_frame
# ---------- python_6: Python ----------
from compas_ghpython import draw_frame

ee_frame = draw_frame(robot.forward_kinematics(configuration, group=group))
# ---------- end python_6 ----------

# ----
# IK solution - assembly_wcf_inclampapproach
# IK solution - assembly_wcf_inclamp (columns)
# IK solution - assembly_wcf_final_retract
button_2 = Button()
iksolution = GhPythonScript(
    robot=robot_2,
    group=group,
    goal_plane=flange_pos_in_robworld.assembly_wcf_inclampapproach,
    attempts=Slider(20, range=0..100),
    acm=set_attached_cm.acm,
    constraints=jointconstraint.joint_constraint,
    start_configuration=pickup_fconfig,
    compute=Button())  # -> out, configuration; inputs attempts: Int32, constraints: list
# ---------- iksolution: Python ----------
from compas_rhino.geometry import RhinoPlane

frame = RhinoPlane.from_geometry(goal_plane).to_compas()

#guid = str(ghenv.Component.InstanceGuid)
#response_key = "response_" + guid
#if response_key not in sc.sticky:
#    sc.sticky[response_key] = None

if not compute:
    if start_configuration is None:
        start_configuration = robot.zero_configuration()
    
    options = {
        'avoid_collisions' : True,
        'attempts' : attempts,
        'return_full_configuration' : True,
        'attached_collision_meshes' : [acm],
        'constraints' : constraints,
        }
        
    configuration = robot.inverse_kinematics(frame, start_configuration, group, options)
    
    print("Found configuration", configuration)
# ---------- end iksolution ----------
iksolution_2 = GhPythonScript(
    robot=robot_2,
    group=group,
    goal_plane=flange_pos_in_robworld.assembly_wcf_finalretract,
    acm=set_attached_cm.acm,
    path_constraints=jointconstraint.joint_constraint,
    start_configuration=iksolution.configuration,
    compute=button_2)  # -> out, configuration; inputs path_constraints: list
# ---------- iksolution_2: Python ----------
from compas_rhino.geometry import RhinoPlane

frame = RhinoPlane.from_geometry(goal_plane).to_compas()

#guid = str(ghenv.Component.InstanceGuid)
#response_key = "response_" + guid
#if response_key not in sc.sticky:
#    sc.sticky[response_key] = None

if not compute:
    if start_configuration is None:
        start_configuration = robot.zero_configuration()
    
    options = {
        'avoid_collisions' : True,
        'attempts' : 10,
        'return_full_configuration' : True,
        'attached_collision_meshes' : [acm],
        'constraints' : path_constraints,
        }
        
    configuration = robot.inverse_kinematics(frame, start_configuration, group, options)
    
    print("Found configuration", configuration)
# ---------- end iksolution_2 ----------

send_to_each_robot = GhPythonScript(
    robot_11=ghpython_script.robot_11,
    robot_12=ghpython_script.robot_12,
    robot_11_values=merge_3,
    robot_12_values=robot_12_yz_6joints,
    send_robot_11=gantry_guy,
    send_robot_12=Button())  # -> out; inputs robot_11_values: list, robot_12_values: list
# ---------- send_to_each_robot: Python ----------
import compas_rrc as rrc
from compas_fab.robots import to_degrees

speed = 250.0
zone = rrc.Zone.Z1


ext_values = robot_11_values[0:3]
joint_values = robot_11_values[3:10]
print ("send_robot_11 joint_values")
print (joint_values)
print ("send_robot_11 ext_values")
print (ext_values)
if send_robot_11:
    robot_11.send(rrc.MoveToJoints(joint_values, ext_values, speed, zone))

ext_values = robot_11_values[0:1] + robot_12_values[0:2]
joint_values = robot_12_values[2:9]
print ("send_robot_12 joint_values")
print (joint_values)
print ("send_robot_12 ext_values")
print (ext_values)
if send_robot_12:
    robot_12.send(rrc.MoveToJoints(joint_values, ext_values, speed, zone))
# ---------- end send_to_each_robot ----------
panel_20 = Panel(iksolution.out)

linear_move_start_config = Data(iksolution.configuration)
linear_move_end_config = Data(iksolution_2.configuration)
filter = StreamFilter(Gate=list, Stream0=pickup_fconfig, Stream1=linear_move_end_config)
filter_2 = StreamFilter(Gate=list, Stream0=linear_move_start_config, Stream1=pickup_fconfig)
filter_3 = StreamFilter(Gate=list, Stream0=flange_pos_in_robworld.assembly_wcf_inclampapproach, Stream1=python_6.ee_frame)
starting_config = Data(filter)
goal_config = Data(filter_2)
goal_plane = Plane(filter_3)

panel_21 = Panel(send_to_each_robot)

allowed_planning_time_3 = Slider(10, range=0..15)
clear_previously_saved_trajectory_3 = Button()
plan_motion_4 = Button()
plan_motion_5 = Button()
transform_design_to_robotworld_7 = Transform({TransformCount=1, Name="Orientation", source.origin.x=-50, source.origin.y=850, source.origin.z=0, source.xaxis.x=0, source.xaxis.y=-1, source.xaxis.z=0, source.yaxis.x=1, source.yaxis.y=0, source.yaxis.z=0, target.origin.x=24991.934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})
link2_extraacm = Mesh(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)
link3_extraacm = Mesh(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)
list_4 = ValueList({"RRT", "RRT*": "RRTStar", "EST", "PRM": "RPM", "PRM*": "RPMStar", "SPARS"}, selected="RRT*")
plan_no_clamp_path = GhPythonScript(
    process=process_3,
    robot=robot_2,
    group=group,
    pick_up_full_config=pickup_fconfig,
    joint_constraints=jointconstraint.joint_constraint,
    environment_mesh=mjoin,
    robot_link2_acm=link2_extraacm,
    robot_link3_acm=link3_extraacm,
    planner_id=list_4,
    allowed_planning_time=allowed_planning_time_3,
    num_planning_attempts=Slider(1, range=0..10),
    beam_id=item_3,
    robot_world_transform=transform_design_to_robotworld_7,
    compute=plan_motion_4,
    compute2=plan_motion_5,
    clear_prev_traj=clear_previously_saved_trajectory_3)  # -> out, trajectory_1, t1_end_frame, trajectory_2, t2_end_frame, a; inputs joint_constraints: list, environment_mesh: Mesh, robot_link2_acm: Mesh, robot_link3_acm: Mesh, robot_world_transform: Transform
# ---------- plan_no_clamp_path: Python ----------
from compas.geometry import Frame, Transformation
from compas_ghpython import draw_frame
from compas_rhino.geometry import RhinoMesh
from compas_fab.robots import CollisionMesh, AttachedCollisionMesh
from compas_fab.robots import AttachedCollisionMesh
from compas.datastructures import meshes_join
from copy import deepcopy
import math

# Code to cache (and clear) planned trajectory in Sticky
import scriptcontext as sc
guid = str(ghenv.Component.InstanceGuid)
trajectory_1_key = "traj1_" + guid
trajectory_2_key = "traj2_" + guid
if (trajectory_1_key not in sc.sticky) or clear_prev_traj: sc.sticky[trajectory_1_key] = None
if (trajectory_2_key not in sc.sticky) or clear_prev_traj: sc.sticky[trajectory_2_key] = None

# Function to deal with transformation from design_world to robot_world
def transformation_from_xform(transformation):
    """Creates a Compas Transformation instance from a Rhino Transform
    """
    transform = Transformation()
    for i in range(0, 4):
        for j in range(0, 4):
            transform[i, j] = transformation[i, j]
    return transform
    
robot_world_transform = transformation_from_xform(robot_world_transform)

def flange_frame_at(process, beam_id, attribute_name, transformation = None):
    """ Returns the T0CP (robot flange) for the gripper at different location.
    The result takes into account the gripper (tool) and toolchanger (tool) offsets.
    
    Optional transformation can be supplied for transforming from design-world to Robot-world
    This function has a side effect changing the process.toolchanger and gripper 's current frame.
    """
    if process.get_gripper_t0cp_for_beam_at(beam_id, attribute_name) is None:
        return None  # Return None if the position doesn't exist

    assembly = process.assembly
    gripper_type = assembly.get_beam_attribute(beam_id, 'gripper_type')
    gripper = process.get_one_gripper_by_type(gripper_type)
    toolchanger = process.robot_toolchanger

    gripper_t0cp = process.get_gripper_t0cp_for_beam_at(beam_id, attribute_name)
    toolchanger.set_current_frame_from_tcp(gripper_t0cp)
    t0cp = toolchanger.current_frame.copy()
    # Post transformation
    if transformation is not None:
        t0cp.transform(transformation)
    return t0cp

######################################
# Perhaps functional settings for OMPL
######################################

import roslibpy
maximum_waypoint_distance = 0.0000001
roslibpy.Param(robot.client, '/move_group/ompl/maximum_waypoint_distance').set(maximum_waypoint_distance)
longest_valid_segment_fraction = 0.00000001
reply = roslibpy.Param(robot.client, '/move_group/ompl/longest_valid_segment_fraction').set(longest_valid_segment_fraction)

##########################################################
# Extract and transform the target plans from process file
##########################################################

#if process.get_gripper_t0cp_for_beam_at(beam_id, 'assembly_wcf_inclampapproach'):
#    assembly_wcf_inclampapproach =  draw_frame(flange_frame_at(process, beam_id, 'assembly_wcf_inclampapproach', robot_world_transform))
#else:
#    assembly_wcf_inclampapproach =  draw_frame(flange_frame_at(process, beam_id, 'assembly_wcf_inclamp', robot_world_transform))
assembly_wcf_inclamp =  flange_frame_at(process, beam_id, 'assembly_wcf_inclamp', robot_world_transform)
assembly_wcf_final =  flange_frame_at(process, beam_id, 'assembly_wcf_final', robot_world_transform)
assembly_wcf_finalretract =  flange_frame_at(process, beam_id, 'assembly_wcf_finalretract', robot_world_transform)

######################################################
# Extract and transform geometry from process file.
######################################################

def get_previous_beams_meshes(process, beam_id, transformation = None):
    beam_meshes = []
    for this_beam_id in process.assembly.get_already_built_beams(beam_id):
        beam_mesh = process.assembly.beam(this_beam_id).cached_mesh.copy()
        if transformation is not None:
            beam_mesh.transform(transformation)
        beam_meshes.append(beam_mesh)
    return beam_meshes

def get_clamp_meshes(process, beam_id, clamp_jaw_position = 120, gripper_jaw_position = 0, transformation = None):
    clamps_on_structure = []
    # Visualize clamps
    for neighbour_id in process.assembly.get_already_built_neighbors(beam_id):
        joint_id = (neighbour_id, beam_id)
        clamp_wcf_final = process.assembly.get_joint_attribute(joint_id, 'clamp_wcf_final')
        clamp_type = process.assembly.get_joint_attribute(joint_id, 'clamp_type')
        clamp = process.get_one_clamp_by_type(clamp_type).copy()
        clamp.current_frame = clamp_wcf_final
        clamp.clamp_jaw_position = clamp_jaw_position
        clamp.gripper_jaw_position = gripper_jaw_position
        clamps_on_structure += [m.transformed(transformation) for m in clamp.draw_visuals()]
    return clamps_on_structure

def get_meshes_for_acm(process, beam_id):
    # Tool changer (At Origin)
    toolchanger = process.robot_toolchanger
    toolchanger.current_frame = Frame.worldXY()
    tc_meshes =  [m.copy() for m in toolchanger.draw_visuals()]
    
    # Gripper (At Tool Changer)
    gripper_type = process.assembly.get_beam_attribute(beam_id, 'gripper_type')
    gripper = process.get_one_gripper_by_type(gripper_type)
    gripper.current_frame = process.robot_toolchanger.tool_coordinate_frame.copy()
    tool_meshes =  [m.copy() for m in gripper.draw_visuals()]
    
    
    gripper_t0cp = process.get_gripper_t0cp_for_beam_at(beam_id, 'assembly_wcf_final')
    T = Transformation.from_frame_to_frame(gripper_t0cp, gripper.current_frame.copy())
    beam_mesh = beam.cached_mesh.transformed(T)
    
    return (tc_meshes, tool_meshes, beam_mesh)

# Beam (At Final Location)
beam = process.assembly.beam(beam_id)
current_beam_at_wcf_final = beam.cached_mesh.transformed(robot_world_transform)


######################################
# Plan First motion (Transfer - Free)
######################################

# Setup planning scene
from compas_fab.robots import PlanningScene
scene = PlanningScene(robot)

# Static CM (Environment + Previous Beams)
scene.remove_collision_mesh('static_cm_env')
environment_mesh = RhinoMesh.from_geometry(environment_mesh).to_compas()
scene.add_collision_mesh(CollisionMesh(deepcopy(environment_mesh), 'static_cm_env'), True)

scene.remove_collision_mesh('static_cm_beams')
previous_beams_meshes = get_previous_beams_meshes(process, beam_id, robot_world_transform)
if len(previous_beams_meshes):
    previous_beams_meshes = meshes_join(previous_beams_meshes)
    scene.add_collision_mesh(CollisionMesh(deepcopy(previous_beams_meshes), 'static_cm_beams'), True)

#scene.remove_collision_mesh('static_cm_clamps')
#static_clamps_mesh = get_clamp_meshes(process, beam_id, 120, 0, robot_world_transform)
#if len(static_clamps_mesh):
#    static_clamps_mesh = meshes_join(static_clamps_mesh)
#    scene.add_collision_mesh(CollisionMesh(deepcopy(static_clamps_mesh), 'static_cm_clamps'), True)

# Attached CM (Tool changer and Tool)
ee_link_name = robot.get_end_effector_link_name(group) # Attached to this link
preee_link_name = robot.get_end_effector_link(group).parent_joint.parent.link # Allowed to touch this link
tc_meshes, tool_meshes, current_beam_at_acm =  get_meshes_for_acm(process, beam_id)
scene.remove_attached_collision_mesh('attached_cm_tool')
tc_tool_meshes = meshes_join(tc_meshes + tool_meshes)
attached_cm_tool = AttachedCollisionMesh(CollisionMesh(tc_tool_meshes, 'attached_cm_tool'), ee_link_name, [ee_link_name, preee_link_name])
scene.add_attached_collision_mesh(attached_cm_tool, True)

# Attached CM (Pipes around Robot)
scene.remove_attached_collision_mesh('attached_cm_pipe2')
robot_link2_acm = RhinoMesh.from_geometry(robot_link2_acm).to_compas()
attached_cm_pipe2 = AttachedCollisionMesh(CollisionMesh(robot_link2_acm, 'attached_cm_pipe2'), 'robot12_link_2', ['robot12_link_2'])
scene.add_attached_collision_mesh(attached_cm_pipe2, True)

scene.remove_attached_collision_mesh('attached_cm_pipe3')
robot_link3_acm = RhinoMesh.from_geometry(robot_link3_acm).to_compas()
attached_cm_pipe3 = AttachedCollisionMesh(CollisionMesh(robot_link3_acm, 'attached_cm_pipe3'), 'robot12_link_3', ['robot12_link_3'])
scene.add_attached_collision_mesh(attached_cm_pipe3, True)

# Attached CM (Current Beam)
scene.remove_attached_collision_mesh('attached_cm_beam')
attached_cm_beam = AttachedCollisionMesh(CollisionMesh(current_beam_at_acm, 'attached_cm_beam'), ee_link_name, [ee_link_name, preee_link_name])
scene.add_attached_collision_mesh(attached_cm_beam, True)

# Creating starting configuration
start_configuration =  pick_up_full_config

# Creating Goal Constraint (assembly_wcf_inclamp)
tolerance_deg = 0.1
tolerance_position = 0.001
tolerances_axes = [math.radians(tolerance_deg)] * 3
goal_constraints = robot.constraints_from_frame(assembly_wcf_inclamp, tolerance_position, tolerances_axes, group)


if compute and robot and robot.client and robot.client.is_connected:
    trajectory_1 = robot.plan_motion(
                                    goal_constraints,
                                    start_configuration,
                                    group,
                                    options = {
                                        'path_constraints' : joint_constraints,
                                        'planner_id' : str(planner_id),
                                        'attached_collision_meshes' : [attached_cm_tool, attached_cm_pipe2, attached_cm_pipe3, attached_cm_beam],
                                        'allowed_planning_time' : allowed_planning_time,
                                        'num_planning_attempts' : num_planning_attempts
                                        }
                                    )
    sc.sticky[trajectory_1_key] = trajectory_1
                                    
if compute2 and robot and robot.client and robot.client.is_connected:
    trajectory_1 = sc.sticky[trajectory_1_key]
    trajectory_1_last_config = trajectory_1.points[-1] # Partial Config
    trajectory_1_last_config = robot.merge_group_with_full_configuration(trajectory_1_last_config, trajectory_1.start_configuration, group) #Full Config
    print (trajectory_1_last_config)
    start_configuration = trajectory_1_last_config
    frames_WCF = [assembly_wcf_inclamp, assembly_wcf_final]
    trajectory_2 = robot.plan_cartesian_motion(
                                    frames_WCF ,
                                    start_configuration,
                                    group,
                                    options = {
                                        'max_step' : 4,
                                        'path_constraints' : joint_constraints,
                                        'attached_collision_meshes' : [attached_cm_tool, attached_cm_pipe2, attached_cm_pipe3],
                                        }
                                    )
    sc.sticky[trajectory_2_key] = trajectory_2

#    if trajectory_1 is not None:
#        # If previous plan is successful
#        # Plan Second path (To Final - Linear)
#        scene.remove_attached_collision_mesh('attached_cm_beam')
#        trajectory_2 = robot.plan_cartesian_motion(
#                                    assembly_wcf_final,
#                                    start_configuration,
#                                    group,
#                                    options = {
#                                        'path_constraints' : joint_constraints,
#                                        'planner_id' : str(planner_id),
#                                        'attached_collision_meshes' : [attached_cm_tool, attached_cm_pipe2, attached_cm_pipe3, attached_cm_beam],
#                                        'allowed_planning_time' : allowed_planning_time,
#                                        'num_planning_attempts' : num_planning_attempts
#                                        }
#                                    )

                                    
   
    





# Attached CM (Take away current beam)

trajectory_1 = sc.sticky[trajectory_1_key]
trajectory_2 = sc.sticky[trajectory_2_key]

t1_end_frame = assembly_wcf_inclamp
t2_end_frame = assembly_wcf_final
# ---------- end plan_no_clamp_path ----------

# ----
# Visualize - Attached CM at Pickup
orient_2 = Orient(Geometry=acm_rhino_mesh, Source=PlaneXY(0, 0, 0), Target=python_6.ee_frame)  # -> Geometry, Transform
preview_5 = CustomPreview(Geometry=orient_2.Geometry, Shader=ColourSwatch(SwatchColor=RGBA(153, 255, 0, 0)))

configurationconstraint = GhPythonScript(configuration=goal_config, joint_name=panel_16)  # -> out, joint_constraint
# ---------- configurationconstraint: Python ----------
from compas_fab.robots import JointConstraint
from math import radians

values = dict(zip(configuration.joint_names, configuration.values))

print (configuration.joint_names)
value = values[joint_name]
tolerance_rad  = radians(3)

print (value)
joint_constraint = JointConstraint(joint_name, value, tolerance_rad, tolerance_rad, 1.0)
# ---------- end configurationconstraint ----------
rec_2 = DataRecorder(plan_no_clamp_path.out, DataLimit=-10, RecordData=True)
panel_22 = Panel(rec_2)
python_7 = GhPythonScript(x=plan_no_clamp_path.t1_end_frame)  # -> out, a
# ---------- python_7: Python ----------
print (x)
# ---------- end python_7 ----------
send_trajectory_columns = GhPythonScript(
    robot_11=ghpython_script.robot_11,
    robot_12=ghpython_script.robot_12,
    trajectory1=plan_no_clamp_path.trajectory_1,
    t1_end_frame=plan_no_clamp_path.t1_end_frame,
    trajectory2=plan_no_clamp_path.trajectory_2,
    t2_end_frame=plan_no_clamp_path.t2_end_frame,
    reverse=reverse,
    send_pickup_point=Button(),
    send1=Button(),
    send_t1_end=Button(),
    send2=button)  # -> out
# ---------- send_trajectory_columns: Python ----------
import compas_rrc as rrc
from compas_fab.robots import to_degrees
from copy import deepcopy
speed = 500.0

t1_start_config_dict = dict(zip(trajectory1.start_configuration.joint_names, trajectory1.start_configuration.values))
t1_gantry_x = t1_start_config_dict['bridge1_joint_EA_X']

# Sending Trajectory 1 (Transfer)
if send1:
    robot_12.send(rrc.SetWorkObject('wobj0'))
    robot_12.send(rrc.SetTool('tool0'))
    robot_12.send(rrc.PrintText('Trajectory 1 begins'))
    
    # Reset Robot 11 joints to parking Joints
    #TODO
    
    # Send Gantry to correct X position first (with 30 sec initial wait)
    robot_11_current_joints, robot_11_current_ext = robot_11.send_and_wait(rrc.GetJoints(), timeout=30)
    robot_11_current_ext[0] = t1_gantry_x
    robot_11.send(rrc.MoveToJoints(robot_11_current_joints, robot_11_current_ext, 500, rrc.Zone.FINE))
    
    # Send the rest of the trajectory
    t1_points = deepcopy(trajectory1.points)
    if reverse:
        t1_points = list(reversed(t1_points))
    
    for point in t1_points:
        assert len(point.values) == 8
        ext_values = [t1_gantry_x] + point.values[0:2]
        joint_values = to_degrees(point.values[2:9])
        print (joint_values, ext_values)
        robot_12.send(rrc.MoveToJoints(joint_values, ext_values, speed, rrc.Zone.Z1))
        
    robot_12.send(rrc.PrintText('Trajectory 1 completed'))
    
if send_t1_end:
    robot_12.send(rrc.SetWorkObject('wobj0'))
    robot_12.send(rrc.SetTool('tool0'))
    # Send the last point as moveL 
    t1_points = deepcopy(trajectory1.points)
    t1_last_ext_values = [t1_gantry_x] + t1_points[-1].values[0:2]
    robot_12.send(rrc.MoveToRobtarget(t1_end_frame, t1_last_ext_values, 100, rrc.Zone.FINE))

if send2:
    robot_12.send(rrc.SetWorkObject('wobj0'))
    robot_12.send(rrc.SetTool('tool0'))
    robot_12.send(rrc.PrintText('Trajectory 2 begins'))
    
    # Make Robot Soft
    robot_12.send(rrc.CustomInstruction('r_A067_ActSoftServo'))
    
    # Send the trajectory
    t2_points = deepcopy(trajectory2.points)
    if reverse:
        t2_points = list(reversed(t2_points))
    
    for point in t2_points:
        assert len(point.values) == 8
        ext_values = [t1_gantry_x] + point.values[0:2]
        joint_values = to_degrees(point.values[2:9])
        print (joint_values, ext_values)
        robot_12.send(rrc.MoveToJoints(joint_values, ext_values, 100, rrc.Zone.Z1))

    # Send the last point as moveL 
    t2_last_ext_values = [t1_gantry_x] + t2_points[-1].values[0:2]
    robot_12.send(rrc.MoveToRobtarget(t2_end_frame, t2_last_ext_values, 100, rrc.Zone.FINE))

    # Send the robot to be hard again
    robot_12.send(rrc.CustomInstruction('r_A067_DeactSoftServo'))
    
    robot_12.send(rrc.PrintText('Trajectory 2 completed'))
# ---------- end send_trajectory_columns ----------

waypoints = PythonScript(robot=robot_2, group=group, trajectory=plan_no_clamp_path.trajectory_1)  # -> configurations, full_configurations, planes, points, fraction, time
# ---------- waypoints: Python ----------
import Rhino.Geometry as rg

from compas_ghpython import draw_frame

planes = []
points = []

if trajectory:
    configurations = trajectory.points
    full_configurations = [robot.merge_group_with_full_configuration(c, trajectory.start_configuration, group) for c in configurations]
    start_configuration = trajectory.start_configuration
    fraction = trajectory.fraction
    time = trajectory.time_from_start

    for c in full_configurations:
        frame_WCF = robot.forward_kinematics(c, group, options = {'backend' : 'model'})
        planes.append(draw_frame(frame_WCF))
        points.append(rg.Point3d(*list(frame_WCF.point)))
# ---------- end waypoints ----------
waypoints_2 = PythonScript(robot=robot_2, group=group, trajectory=plan_no_clamp_path.trajectory_2)  # -> configurations, full_configurations, planes, points, fraction, time; same code as waypoints
pline = PolyLine(Vertices=waypoints.points, Closed=False)
pline_2 = PolyLine(Vertices=waypoints_2.points, Closed=False)
lng = ListLength(List=waypoints_2.points)
lng_2 = ListLength(List=waypoints.points)
merge_4 = Merge(Data1=flatten(waypoints.full_configurations), Data2=flatten(waypoints_2.full_configurations))
preview_6 = CustomPreview(Geometry=[pline, waypoints.points], Material=ColourSwatch(SwatchColor=RGB(59, 161, 95)))
preview_7 = CustomPreview(Geometry=[pline_2, waypoints_2.points], Material=ColourSwatch(SwatchColor=RGB(59, 154, 161)))
len_points = Panel(lng)
null = NullItem(Item=merge_4)  # -> NullFlags, InvalidFlags, Description
len_points_2 = Panel(lng_2)
cull = CullPattern(List=merge_4, CullPattern=invert(null.NullFlags))

rec_3 = DataRecorder(send_trajectory_columns, DataLimit=-10, RecordData=True)
panel_23 = Panel(rec_3)

# ----
# Save Trajectory
trajectory_path = GhPythonScript(beam_id=item_3)  # -> t_1_path, t_2_path
# ---------- trajectory_path: Python ----------
from Rhino.RhinoDoc import ActiveDoc
import os
t_1_path = os.path.dirname(ActiveDoc.Path) + os.path.sep + "trajectory_" + beam_id + "_t1.json"
t_2_path = os.path.dirname(ActiveDoc.Path) + os.path.sep + "trajectory_" + beam_id + "_t2.json"
# ---------- end trajectory_path ----------
panel_24 = Panel(trajectory_path.t_1_path)
save = Button()
save_2 = Button()
python_8 = GhPythonScript(trajectory=plan_no_clamp_path.trajectory_2, path=trajectory_path.t_2_path, save=save)  # -> out, a; inputs save: Boolean
# ---------- python_8: Python ----------
import json
if save: 
    with open(path, "w") as outfile: 
        json.dump(trajectory.data, outfile)
# ---------- end python_8 ----------
python_9 = GhPythonScript(trajectory=plan_no_clamp_path.trajectory_1, path=trajectory_path.t_1_path, save=save_2)  # -> out, a; inputs save: Boolean; same code as python_8

clamp_position = Slider(105, range=100..205)

subtraction = Subtraction(A=205, B=clamp_position)
subtraction_2 = Subtraction(A=clamp_position, B=100)

distance_to_final_plane_2 = Panel(subtraction_2)

interpolate_plane = GhPythonScript(start_plane=assembly_wcf_inclamp, end_plane=assembly_wcf_final, interpolate_dist=subtraction)  # -> out, warn_col, warn_msg, interpolated_plane; inputs start_plane: Plane, end_plane: Plane
# ---------- interpolate_plane: Python ----------
from Rhino.Geometry import Plane, Vector3d
warn_col = 'lime'
warn_msg = ''

plane_dist = start_plane.Origin.DistanceTo(end_plane.Origin)
if plane_dist < 100.0 or plane_dist > 120.0:
    warn_col = 'red'
    warn_msg += "Plane Distance not within tolerance (100-120mm)\n"

if start_plane.XAxis.IsParallelTo(end_plane.XAxis, 0.01) != 1:
    warn_col = 'red'
    warn_msg += "Plane are not Rotationally equal. X Axis Check Fail\n"

if start_plane.YAxis.IsParallelTo(end_plane.YAxis, 0.01) != 1:
    warn_col = 'red'
    warn_msg += "Plane are not Rotationally equal. Y Axis Check Fail\n"

if warn_msg == '' :
    warn_msg = "Plane Checks passed\n Plant to Plane distance: %0.1f mm" % plane_dist
    move_vector = Vector3d(end_plane.Origin - start_plane.Origin)
    move_vector.Unitize()
    move_vector = move_vector * interpolate_dist
    new_origin = start_plane.Origin + move_vector
    interpolated_plane = Plane(new_origin, start_plane.XAxis, start_plane.YAxis)
# ---------- end interpolate_plane ----------
legend_2 = Legend(Colour=interpolate_plane.warn_col, Tags=interpolate_plane.warn_msg, LegendType=2)
send_sync_move = GhPythonScript(
    robot=ghpython_script.robot_12,
    clamp=python_3.clamps_connection,
    target_plane=interpolate_plane.interpolated_plane,
    clamp_addresses=visualize_beams_2.clamp_addresses,
    clamp_position=clamp_position,
    velocity=Slider(2, range=1..5),
    execute=Button())  # -> out; inputs target_plane: Plane, clamp_addresses: list
# ---------- send_sync_move: Python ----------
import compas_rrc as rrc

# Convert target plane to compas_frame
from compas_rhino.geometry import RhinoPlane
target_frame = RhinoPlane.from_geometry(target_plane).to_compas()

zone = rrc.Zone.Z0

if execute:
    # Pre Instruction to Clamps
    # Set Velocity
    
    # Pre Instruction to Robot
    robot.send(rrc.SetWorkObject('wobj0'))
    robot.send(rrc.SetTool('tool0'))
    # Take existing External Axis Value so we do not accidentially move it.
    robot_current_robtarget = robot.send_and_wait(rrc.GetRobtarget(), timeout=30)
    print (robot_current_robtarget)
    robot_current_external_exes = robot_current_robtarget[1]
    
    # Read curent frame and send it back immediately
    # robot.send(rrc.CustomInstruction('r_A067_ActSoftServo'))
    
    # Send command to clamp
    clamp.send_ROS_VEL_GOTO_COMMAND(clamp_addresses, clamp_position, velocity)
    
    # Send command to robot
    robot.send(rrc.MoveToRobtarget(target_frame, robot_current_external_exes, velocity, zone, motion_type=rrc.Motion.LINEAR))
# ---------- end send_sync_move ----------
move_robot_to_plane = GhPythonScript(send=send, robot=ghpython_script.robot_12, target_plane=interpolate_plane.interpolated_plane)  # -> out; inputs send: Boolean
# ---------- move_robot_to_plane: Python ----------
import compas.geometry as cg
from compas_rrc import *
from compas_ghpython import draw_frame

from compas_rhino.geometry import RhinoPlane
target_frame = RhinoPlane.from_geometry(target_plane).to_compas()

if send:
    
    robot.send(SetWorkObject('wobj0'))
    robot.send(SetTool('tool0'))

    # Take existing External Axis Value so we do not accidentially move it.
    robot_current_robtarget = robot.send_and_wait(GetRobtarget(), timeout=1)
    print (robot_current_robtarget)
    robot_current_external_exes = robot_current_robtarget[1]

    speed = 50 #mm/s
    zone = Zone.FINE

#    robot.send_and_wait(MoveToRobtarget(target_frame, robot_current_external_exes, speed, zone, motion_type=Motion.LINEAR), timeout=1)
    robot.send(MoveToRobtarget(target_frame, robot_current_external_exes, speed, zone, motion_type=Motion.LINEAR))
# ---------- end move_robot_to_plane ----------
rec_4 = DataRecorder(move_robot_to_plane, DataLimit=-10, RecordData=True)
rec_5 = DataRecorder(send_sync_move, DataLimit=-10, RecordData=True)
python_10 = GhPythonScript(
    clamp=python_3.clamps_connection,
    clamp_addresses=visualize_beams_2.clamp_addresses,
    clamp_position=clamp_position,
    velocity=Slider(5, range=1..5),
    execute=Button())  # -> out, a
# ---------- python_10: Python ----------
import compas_rrc as rrc

if execute:
    # Send command to clamp
    clamp.send_ROS_VEL_GOTO_COMMAND(clamp_addresses, clamp_position, velocity)
# ---------- end python_10 ----------
panel_25 = Panel(rec_4)
rec_6 = DataRecorder(python_10.out, DataLimit=-10, RecordData=True)
panel_26 = Panel(rec_5)
panel_27 = Panel(rec_6)

# ----
# Plan motion
python_11 = PythonScript(
    robot=robot_2,
    group=group,
    goal_plane=goal_plane,
    tolerance_position=0.001,
    tolerance_xaxis_deg=0.05,
    tolerance_yaxis_deg=0.05,
    tolerance_zaxis_deg=0.05)  # -> goal_constraints
# ---------- python_11: Python ----------
import math
from compas.geometry import Frame
from compas_rhino.geometry import RhinoPlane

frame = RhinoPlane.from_geometry(goal_plane).to_compas()

tolerances_axes = [math.radians(tolerance_xaxis_deg), math.radians(tolerance_yaxis_deg), math.radians(tolerance_zaxis_deg)]

if robot:
    goal_constraints = robot.constraints_from_frame(frame, tolerance_position, tolerances_axes, group)
    print goal_constraints
# ---------- end python_11 ----------
list_5 = ValueList({"RRT", "RRT*": "RRTStar", "EST", "PRM": "RPM", "PRM*": "RPMStar", "SPARS"}, selected="RRT*")

filter_4 = StreamFilter(Gate=force_goal_config, Stream0=python_11, Stream1=[configurationconstraint.joint_constraint, python_11])

# ----
# Save Trajectory
trajectory_path_2 = GhPythonScript(beam_id=item)  # -> path
# ---------- trajectory_path_2: Python ----------
from Rhino.RhinoDoc import ActiveDoc
import os
path = os.path.dirname(ActiveDoc.Path) + os.path.sep + "trajectory_" + beam_id + "_transfer.json"
# ---------- end trajectory_path_2 ----------
panel_28 = Panel(trajectory_path_2)
data_the_one_sent_to_yijiang = Data("Grasshopper.Kernel.Types.GH_ObjectWrapper")

plan_motion_6 = PythonScript(
    robot=robot_2,
    group=group,
    start_configuration=starting_config,
    path_constraints=flatten(jointconstraint.joint_constraint),
    goal_constraints=flatten(filter_4),
    planner_id=list_5,
    attached_collision_meshes=set_attached_cm.acm,
    allowed_planning_time=allowed_planning_time,
    num_planning_attempts=Slider(1, range=0..10),
    compute=plan_motion_2,
    clear_prev_traj=clear_previously_saved_trajectory_2)  # -> out, trajectory; inputs path_constraints: list, goal_constraints: list, attached_collision_meshes: list
#   port group: str, optional The planning group used for calculation. Defaults to the robot's main planning group.
#   port compute: bool Press to calculate solution.
# ---------- plan_motion_6: Python ----------
"""Calculates a motion path.

        Parameters
        ----------
        goal_constraints: list of :class:`compas_fab.robots.Constraint`
            The goal to be achieved, defined in a set of constraints.
            Constraints can be very specific, for example defining value domains
            for each joint, such that the goal configuration is included,
            or defining a volume in space, to which a specific robot link (e.g.
            the end-effector) is required to move to.
        start_configuration: :class:`compas_fab.robots.Configuration`, optional
            The robot's full configuration, i.e. values for all configurable
            joints of the entire robot, at the starting position. Defaults to
            the all-zero configuration.
        group: str, optional
            The name of the group to plan for. Defaults to the robot's main
            planning group.
        options : dict, optional
            Dictionary containing the following key-value pairs:

            - path_constraints :: list of :class:`compas_fab.robots.Constraint`, optional
                Optional constraints that can be imposed along the solution path.
                Note that path calculation won't work if the start_configuration
                violates these constraints. Defaults to `None`.
            - planner_id :: str
                The name of the algorithm used for path planning. Defaults to 'RRT'.
            - num_planning_attempts :: int, optional
                Normally, if one motion plan is needed, one motion plan is computed.
                However, for algorithms that use randomization in their execution
                (like 'RRT'), it is likely that different planner executions will
                produce different solutions. Setting this parameter to a value above
                1 will run many additional motion plans, and will report the
                shortest solution as the final result. Defaults to `1`.
            - allowed_planning_time :: float
                The number of seconds allowed to perform the planning. Defaults to `2`.
            - max_velocity_scaling_factor :: float
                Defaults to `1`.
            - max_acceleration_scaling_factor :: float
                Defaults to `1`.
            - attached_collision_meshes :: list of :class:`compas_fab.robots.AttachedCollisionMesh`
                Defaults to `None`.

        Returns
        -------
        :class:`compas_fab.robots.JointTrajectory`
            The calculated trajectory.

"""


from __future__ import print_function
import logging
import scriptcontext as sc
import math
from compas_fab.robots import JointConstraint

import roslibpy
maximum_waypoint_distance = 0.1
param = roslibpy.Param(robot.client, '/move_group/ompl/maximum_waypoint_distance')
param.set(maximum_waypoint_distance, callback=print())
longest_valid_segment_fraction = 0.00000001
#longest_valid_segment_fraction = 0.01
param = roslibpy.Param(robot.client, '/move_group/ompl/longest_valid_segment_fraction')
param.set(longest_valid_segment_fraction, callback=print())

guid = str(ghenv.Component.InstanceGuid)
response_key = "response_" + guid
if response_key not in sc.sticky:
    sc.sticky[response_key] = None

LOGGER = logging.getLogger('roslibpy')

if clear_prev_traj:
    sc.sticky[response_key] = None
    
if robot and robot.client and start_configuration and compute:
    if robot.client.is_connected:
        sc.sticky[response_key] = robot.plan_motion(goal_constraints,
                                                    start_configuration,
                                                    group,
                                                    options = {
                                                        'path_constraints' : path_constraints,
                                                        'planner_id' : str(planner_id),
                                                        'attached_collision_meshes' : list(attached_collision_meshes),
                                                        'allowed_planning_time' : allowed_planning_time,
                                                        'num_planning_attempts' : num_planning_attempts
                                                        }
                                                    )
    else:
        print("Robot client is not connected.")

trajectory = sc.sticky[response_key]
# ---------- end plan_motion_6 ----------
py_3 = PythonScript(robot=robot_2, group=group, trajectory=plan_motion_6.trajectory)  # -> configurations, full_configurations, fraction, time
# ---------- py_3: Python ----------
if trajectory:
    configurations = trajectory.points
    full_configurations = [robot.merge_group_with_full_configuration(c, trajectory.start_configuration, group) for c in configurations]
    start_configuration = trajectory.start_configuration
    fraction = trajectory.fraction
    time = trajectory.time_from_start
# ---------- end py_3 ----------
fraction = Panel(py_3.fraction)
time_s = Panel(py_3.time)
path = GhPythonScript(robot=robot_2, group=group, full_configurations=py_3.full_configurations)  # -> frames, P; inputs full_configurations: list
# ---------- path: Python ----------
import Rhino.Geometry as rg

frames = []

if robot:
    for c in full_configurations:
        if c:
            frame_WCF = robot.forward_kinematics(c, group, options = {'backend' : 'model'})
            frames.append(frame_WCF)

    P = [rg.Point3d(*list(frame.point)) for frame in frames]
# ---------- end path ----------
pline_3 = PolyLine(Vertices=path.P, Closed=False)
preview_8 = CustomPreview(Geometry=[path.P, pline_3], Material=ColourSwatch(SwatchColor=RGB(59, 161, 95)))

send_fake_multimove = GhPythonScript(robot_11=ghpython_script.robot_11, robot_12=ghpython_script.robot_12, trajectory=plan_motion_6.trajectory, send=Button())  # -> out; inputs send: Boolean
# ---------- send_fake_multimove: Python ----------
import compas_rrc as rrc
from compas_fab.robots import to_degrees

speed = 250.0
zone = rrc.Zone.Z1

if send:
    robot_11_current_joints, robot_11_current_ext = robot_11.send_and_wait(rrc.GetJoints(), timeout=30)
    print robot_11_current_joints
    

    for point in trajectory.points:
        print point
        gantry_x_val = point.values[0]
        robot_11_current_ext[0] = gantry_x_val
        robot_12_joints = to_degrees(point.values[3:10])
        robot_12_ext = point.values[0:3]
        print(robot_11_current_joints, robot_11_current_ext)
        print(robot_12_joints, robot_12_ext)
        
        robot_11.send(rrc.MoveToJoints(robot_11_current_joints, robot_11_current_ext, speed, zone))
        robot_12.send_and_wait(rrc.MoveToJoints(robot_12_joints, robot_12_ext, speed, zone), timeout=30)
# ---------- end send_fake_multimove ----------
rec_7 = DataRecorder(send_fake_multimove, DataLimit=-10, RecordData=True)
panel_29 = Panel(rec_7)
# IK solution - assembly_wcf_inclampapproach
# IK solution - assembly_wcf_inclamp (columns)
rec_8 = DataRecorder(plan_motion_6.out, DataLimit=-10, RecordData=True)

panel_30 = Panel(rec_8)

python_12 = GhPythonScript(trajectory=plan_motion_6.trajectory, path=trajectory_path_2, save=Button())  # -> out, a; inputs save: Boolean; same code as python_8

send_trajectory_first_point = GhPythonScript(robot=ghpython_script.robot_12, trajectory=plan_motion_6.trajectory, send_first_point=Button())  # -> out
# ---------- send_trajectory_first_point: Python ----------
import compas_rrc as rrc
from compas_fab.robots import to_degrees

speed = 250.0
zone = rrc.Zone.Z1

if send_first_point:
    point = trajectory.points[0]
    ext_values = [22739] + point.values[0:2]
    joint_values = to_degrees(point.values[2:9])
    print (joint_values, ext_values)
    robot.send(rrc.MoveToJoints(joint_values, ext_values, speed, zone))
# ---------- end send_trajectory_first_point ----------
send_trajectory = GhPythonScript(robot=ghpython_script.robot_12, trajectory=plan_motion_6.trajectory, reverse=reverse_2, send=Button())  # -> out
# ---------- send_trajectory: Python ----------
import compas_rrc as rrc
from compas_fab.robots import to_degrees

speed = 250.0
zone = rrc.Zone.Z1

if send:
    if reverse:
        for point in reversed(trajectory.points):
            ext_values = [22739] + point.values[0:2]
            joint_values = to_degrees(point.values[2:9])
            print (joint_values, ext_values)
            robot.send(rrc.MoveToJoints(joint_values, ext_values, speed, zone))
    else:
        for point in trajectory.points:
            ext_values = [22739] + point.values[0:2]
            joint_values = to_degrees(point.values[2:9])
            print (joint_values, ext_values)
            robot.send(rrc.MoveToJoints(joint_values, ext_values, speed, zone))
# ---------- end send_trajectory ----------
explode = Explode(Curve=pline_3, Recursive=True)  # -> Segments, Vertices
rec_9 = DataRecorder(send_trajectory, DataLimit=-10, RecordData=True)
len = Length(Curve=explode.Segments)
rec_10 = DataRecorder(send_trajectory_first_point, DataLimit=-10, RecordData=True)
sort = SortList(Keys=len)  # -> Keys, ValuesA
panel_31 = Panel(rec_9)
panel_32 = Panel(rec_10)
panel_33 = Panel(sort.Keys)
last = Last(L=py_3.full_configurations)

# ----
# Plan motion
python_13 = PythonScript(
    robot=robot_2,
    group=group,
    goal_plane=flange_pos_in_robworld.assembly_wcf_final,
    tolerance_position=0.001,
    tolerance_xaxis_deg=0.05,
    tolerance_yaxis_deg=0.05,
    tolerance_zaxis_deg=0.05)  # -> goal_constraints; same code as python_11
list_6 = ValueList({"RRT", "RRT*": "RRTStar", "EST", "PRM": "RPM", "PRM*": "RPMStar", "SPARS"}, selected="RRT")

filter_5 = StreamFilter(Gate=force_goal_config, Stream0=python_13, Stream1=[configurationconstraint.joint_constraint, python_13])

plan_motion_7 = PythonScript(
    robot=robot_2,
    group=group,
    start_configuration=last,
    path_constraints=flatten(jointconstraint.joint_constraint),
    goal_constraints=flatten(filter_5),
    planner_id=list_6,
    attached_collision_meshes=set_attached_cm.acm,
    allowed_planning_time=allowed_planning_time_2,
    num_planning_attempts=Slider(30, range=0..30),
    compute=plan_motion_3,
    clear_prev_traj=clear_previously_saved_trajectory_2)  # -> out, trajectory; inputs path_constraints: list, goal_constraints: list, attached_collision_meshes: list
#   port group: str, optional The planning group used for calculation. Defaults to the robot's main planning group.
#   port compute: bool Press to calculate solution.
# ---------- plan_motion_7: Python ----------
"""Calculates a motion path.

        Parameters
        ----------
        goal_constraints: list of :class:`compas_fab.robots.Constraint`
            The goal to be achieved, defined in a set of constraints.
            Constraints can be very specific, for example defining value domains
            for each joint, such that the goal configuration is included,
            or defining a volume in space, to which a specific robot link (e.g.
            the end-effector) is required to move to.
        start_configuration: :class:`compas_fab.robots.Configuration`, optional
            The robot's full configuration, i.e. values for all configurable
            joints of the entire robot, at the starting position. Defaults to
            the all-zero configuration.
        group: str, optional
            The name of the group to plan for. Defaults to the robot's main
            planning group.
        options : dict, optional
            Dictionary containing the following key-value pairs:

            - path_constraints :: list of :class:`compas_fab.robots.Constraint`, optional
                Optional constraints that can be imposed along the solution path.
                Note that path calculation won't work if the start_configuration
                violates these constraints. Defaults to `None`.
            - planner_id :: str
                The name of the algorithm used for path planning. Defaults to 'RRT'.
            - num_planning_attempts :: int, optional
                Normally, if one motion plan is needed, one motion plan is computed.
                However, for algorithms that use randomization in their execution
                (like 'RRT'), it is likely that different planner executions will
                produce different solutions. Setting this parameter to a value above
                1 will run many additional motion plans, and will report the
                shortest solution as the final result. Defaults to `1`.
            - allowed_planning_time :: float
                The number of seconds allowed to perform the planning. Defaults to `2`.
            - max_velocity_scaling_factor :: float
                Defaults to `1`.
            - max_acceleration_scaling_factor :: float
                Defaults to `1`.
            - attached_collision_meshes :: list of :class:`compas_fab.robots.AttachedCollisionMesh`
                Defaults to `None`.

        Returns
        -------
        :class:`compas_fab.robots.JointTrajectory`
            The calculated trajectory.

"""


from __future__ import print_function
import logging
import scriptcontext as sc
import math
from compas_fab.robots import JointConstraint

import roslibpy
maximum_waypoint_distance = 0.01
param = roslibpy.Param(robot.client, '/move_group/ompl/maximum_waypoint_distance')
param.set(maximum_waypoint_distance, callback=print())
longest_valid_segment_fraction = 0.001
param = roslibpy.Param(robot.client, '/move_group/ompl/longest_valid_segment_fraction')
param.set(longest_valid_segment_fraction, callback=print())

guid = str(ghenv.Component.InstanceGuid)
response_key = "response_" + guid
if response_key not in sc.sticky:
    sc.sticky[response_key] = None

LOGGER = logging.getLogger('roslibpy')

if clear_prev_traj:
    sc.sticky[response_key] = None
    
if robot and robot.client and start_configuration and compute:
    if robot.client.is_connected:
        sc.sticky[response_key] = robot.plan_motion(goal_constraints,
                                                    start_configuration,
                                                    group,
                                                    options = {
                                                        'path_constraints' : path_constraints,
                                                        'planner_id' : str(planner_id),
                                                        'attached_collision_meshes' : list(attached_collision_meshes),
                                                        'allowed_planning_time' : allowed_planning_time,
                                                        'num_planning_attempts' : num_planning_attempts
                                                        }
                                                    )
    else:
        print("Robot client is not connected.")

trajectory = sc.sticky[response_key]
# ---------- end plan_motion_7 ----------
py_4 = PythonScript(robot=robot_2, group=group, trajectory=plan_motion_7.trajectory)  # -> configurations, full_configurations, fraction, time; same code as py_3
fraction_2 = Panel(py_4.fraction)
time_s_2 = Panel(py_4.time)
path_2 = GhPythonScript(robot=robot_2, group=group, full_configurations=py_4.full_configurations)  # -> frames, P; inputs full_configurations: list; same code as path
pline_4 = PolyLine(Vertices=path_2.P, Closed=False)
preview_9 = CustomPreview(Geometry=[path_2.P, pline_4], Material=ColourSwatch(SwatchColor=RGB(59, 161, 95)))

rec_11 = DataRecorder(plan_motion_7.out, DataLimit=-10, RecordData=True)

panel_34 = Panel(rec_11)

filter_6 = StreamFilter(Gate=list_2, Stream2=py_3.full_configurations, Stream3=py_4.full_configurations, Stream4=cull)

# ----
# Visualize - Robot Planned Path
animate = PythonScript(robot=robot_2, group=group, configurations=filter_6, idx=idx)  # -> configuration; inputs configurations: list, idx: Int32
# ---------- animate: Python ----------
import Grasshopper
from compas_fab.utilities import map_range
from compas_fab.robots import Configuration

count = len(configurations)

for i in range(ghenv.Component.Params.Input.Count):
    nslider = ghenv.Component.Params.Input[i].Sources[0]
    if nslider.GetType() == Grasshopper.Kernel.Special.GH_NumberSlider and nslider.NickName == 'idx':
        nslider.Slider.Maximum = max(count - 1, 1)
        nslider.Slider.Minimum = 0
        if nslider.Slider.Value > nslider.Slider.Maximum:
            nslider.Slider.Value = 0

if count and robot and configurations[0] != None:
    configuration = configurations[idx]
# ---------- end animate ----------
filter_7 = StreamFilter(Gate=list_2, Stream0=starting_config, Stream1=goal_config, Stream2=animate, Stream3=animate, Stream4=animate)
show_end_effector_frame = BooleanToggle(True)
show_base_frame = BooleanToggle(False)
show_collision = BooleanToggle(False)
show_frames = BooleanToggle(False)
show_visual = BooleanToggle(True)
show_acm = BooleanToggle(True)
show_tool = BooleanToggle(False)
visualize = PythonScript(
    robot=robot_2,
    acm=set_attached_cm.acm,
    group="robot12_eaYZ",
    configuration=filter_7,
    show_visual=show_visual,
    show_acm=show_acm,
    show_tool=show_tool,
    show_collision=show_collision)  # -> robot, visual, acm_mesh, collision, tool, frames, frames_color, planes, ee_frame; inputs tool_visualization: list of Mesh, show_tool: Boolean
# ---------- visualize: Python ----------
import Rhino.Geometry as rg
import ghpythonlib.components as ghcomp

from compas.geometry import Vector, Point
from compas_ghpython.utilities import draw_pipes
from compas_ghpython.utilities import draw_frame
from compas.geometry import Transformation, Scale

from ghpythonlib.components import Transform as gh_Transform

from System.Drawing import Color
from compas_ghpython import draw_frame
from compas_ghpython.helpers import mesh_draw

if robot and configuration:
    #print configuration
    frames = []
    
    robot.artist.update(configuration, visual=show_visual, collision=show_collision)
    
    if show_visual:
        visual = robot.artist.draw_visual()
    
    if show_tool:
        if robot.attached_tool:
            _ee_frame = robot.forward_kinematics(configuration, group=group)
            tool_T = rg.Transform.PlaneToPlane(rg.Plane.WorldXY, cFrame2rPlane(_ee_frame))
            tool = gh_Transform(tool_visualization, tool_T)
    
    if show_acm:
        _ee_frame = robot.forward_kinematics(configuration, group=group)
        _acm_mesh = acm.collision_mesh.mesh.transformed(Scale.from_factors([robot.scale_factor] * 3))
        _acm_mesh = _acm_mesh.transformed(Transformation.from_frame(_ee_frame))
        acm_mesh = mesh_draw(_acm_mesh)
        
    if show_collision:
        collision = robot.artist.draw_collision()


ee_frame = draw_frame( robot.forward_kinematics(configuration, group=group))
# ---------- end visualize ----------
preview_10 = CustomPreview(Geometry=visualize.visual, Shader=ColourSwatch(SwatchColor=RGBA(105, 105, 105, 0)))
preview_11 = CustomPreview(Geometry=visualize.acm_mesh, Shader=ColourSwatch(SwatchColor=RGBA(112, 112, 112, 218)))
preview_12 = CustomPreview(Geometry=visualize.collision, Shader=ColourSwatch(SwatchColor=RGBA(255, 0, 0, 200)))
preview_13 = CustomPreview(Geometry=visualize.tool, Shader=ColourSwatch(SwatchColor=RGB(66, 66, 66)))
preview_14 = CustomPreview(Geometry=visualize.frames, Shader=visualize.frames_color)

# ----
# Visualize - Attached CM
orient_3 = Orient(Geometry=acm_rhino_mesh, Source=PlaneXY(0, 0, 0), Target=visualize.ee_frame)  # -> Geometry, Transform
preview_15 = CustomPreview(Geometry=orient_3.Geometry, Shader=ColourSwatch(SwatchColor=RGBA(0, 255, 123, 200)))

# ==== cluster Cluster
P = ClusterInput()
deplane = DeconstructPlane(Plane=P)  # -> Origin, XAxis, YAxis, ZAxis
amp = Amplitude(Vector=deplane.ZAxis, Amplitude=Slider(-62, range=-100..100))
move = Move(Geometry=deplane.Origin, Motion=amp)  # -> Geometry, Transform
rev = Reverse(Vector=deplane.YAxis)
pl = ConstructPlane(Origin=move.Geometry, XAxis=deplane.XAxis, YAxis=rev)
pl_2 = ClusterOutput(pl)

# ==== cluster Last
L = ClusterInput()
last_item = ListItem(List=L, Index=-1, Wrap=True)
i = ClusterOutput(last_item)
