# Grasshopper definition Update Tools for Process.gh (Grasshopper 1.0.7)

reload_process_from_disk = Button()
process_path = GhPythonScript()  # -> path
# ---------- process_path: Python ----------
from Rhino.RhinoDoc import ActiveDoc
import os
path = os.path.splitext(ActiveDoc.Path)[0] + "_process.json"
print path
# ---------- end process_path ----------
file_path = FilePath(process_path)
json_unpickle = GhPythonScript(path=file_path, enable=True, reload=reload_process_from_disk)  # -> warn_col, warn_msg, data; inputs enable: Boolean
# ---------- json_unpickle: Python ----------
import jsonpickle
import os
import datetime
if enable and not reload:
    exist = os.path.exists(path)
    if exist:
        with open(path, 'r') as f:
            data = jsonpickle.decode(f.read(), keys=True)
        c_time = datetime.datetime.fromtimestamp(os.path.getmtime(path))
        warn_col = "lime"
        warn_msg = "Process File loaded with %s Beams, %s Clamps, %s Grippers.\n File Modified on %s." % (len(list(data.assembly.beams())), len(list(data.clamps)), len(list(data.grippers)), c_time)
    else:
        warn_col = "orange"    
        warn_msg = "Process File not created yet"
# ---------- end json_unpickle ----------
legend = Legend(Colour=json_unpickle.warn_col, Tags=json_unpickle.warn_msg, LegendType=2)
process = Data(json_unpickle.data)

# ----
# Update Tool Changer
tool_definition_file_location = Panel("tools/TC2.json")
load_tool = LoadTool(filename=tool_definition_file_location)  # -> warn_col, warn_msg, tool_2
legend_2 = Legend(Colour=load_tool.warn_col, Tags=load_tool.warn_msg, LegendType=2)
python = GhPythonScript(process=process, toolchanger=load_tool.tool_2, activate=Button())  # -> out, process_out
# ---------- python: Python ----------
process_out = process

if activate:
    process.robot_toolchanger = toolchanger
# ---------- end python ----------

# ----
# Save Edits
save_process_to_disk = Button()
json_pickle = GhPythonScript(stuff=python.process_out, path=file_path, output=save_process_to_disk)  # -> out; inputs output: Boolean
# ---------- json_pickle: Python ----------
import integral_timber_joints
from integral_timber_joints.process import RobotClampAssemblyProcess

if output:
    import jsonpickle
    json_str = jsonpickle.encode(stuff, keys= True)
    print ("out json_str len:" , len(json_str))
    with open(path, 'w') as f:
        f.write(json_str)
# ---------- end json_pickle ----------

# ==== cluster LoadTool
filename = ClusterInput()
auto_path = GhPythonScript(filename=filename)  # -> json_path
# ---------- auto_path: Python ----------
from Rhino.RhinoDoc import ActiveDoc
import os
json_path = os.path.dirname(ActiveDoc.Path) + os.sep + filename
# ---------- end auto_path ----------
json_unpickle_mesh = GhPythonScript(path=auto_path, enable=True)  # -> warn_col, warn_msg, data; inputs enable: Boolean
# ---------- json_unpickle_mesh: Python ----------
import jsonpickle
import os
import datetime
if enable:
    exist = os.path.exists(path)
    if exist:
        with open(path, 'r') as f:
            data = jsonpickle.decode(f.read(), keys=True)
        c_time = datetime.datetime.fromtimestamp(os.path.getmtime(path))
        warn_col = "lime"
        warn_msg = "%s Object loaded.\n File Modified on %s." % (data.__class__.__name__, c_time)
    else:
        warn_col = "orange"    
        warn_msg = "Tool File not exist"
# ---------- end json_unpickle_mesh ----------
warn_col = ClusterOutput(json_unpickle_mesh.warn_col)
warn_msg = ClusterOutput(json_unpickle_mesh.warn_msg)
tool = Data(json_unpickle_mesh.data)
tool_2 = ClusterOutput(tool)
