# Grasshopper definition RobotTeachingTool.gh (Grasshopper 1.0.7)
# plug-ins: Human

# ----
# Connect to RFL robot via ROS (Execution)
panel = Panel("192.168.0.117")
restart = Button()
ros = PythonScript(ip=panel, restart=restart)  # -> out, ros_client
# ---------- ros: Python ----------
import sys
import time
import scriptcontext as sc

from compas_fab.backends import RosClient

from System import TimeSpan
from System.Threading import ManualResetEventSlim


key = 'rosclient_%s' % str(ghenv.Component.InstanceGuid)
previous_client = sc.sticky.get(key, None)
if previous_client:
    previous_client.terminate()

ros_client = RosClient(ip, 9090)
sc.sticky[key] = ros_client

waitLock = ManualResetEventSlim(False)

ros_client.on_ready(lambda: waitLock.Set())

if not waitLock.Wait(TimeSpan.FromSeconds(5)):
    raise Exception('Unable to connect to ROS')


print "ROS is connected:", ros_client.is_connected
# ---------- end ros ----------
panel_2 = Panel(ros.out)
init_robot = Button()
ghpython_script = GhPythonScript(ros_client=ros.ros_client, init_robot=init_robot)  # -> robot_11, robot_12; inputs init_robot: Boolean
# ---------- ghpython_script: Python ----------
from compas_rrc import *

if ros_client:
    robot_11 = AbbClient(ros_client, "/robot_11")
    robot_12 = AbbClient(ros_client, "/robot_12")
# ---------- end ghpython_script ----------

move_target_plane_up = Slider(150, range=150..1000)
pln = Plane(Plane(origin=(24007.89844, 3854.465137, 934.3125002), x=(-0.2580290177, -0.7401040083, -0.6210210004), y=(-0.9661371673, 0.1976616951, 0.1658578555)))

# ----
# PG1000 Storage Pose
pln_robot_frame = Plane(Plane(origin=(22744.86719, 4645.288086, 531.1309814), x=(-0.9999999944, -6.155314685e-05, 8.638250577e-05), y=(-6.156507724e-05, 0.9999999886, -0.0001381153157)))
num = Number([22350.39648, -4043.425537, -2912.382324, 0, 0, 0])
num_2 = Number([-56.75962067, -26.1083889, -2.848014116, 179.9999237, 61.05321121, 56.75597])
ea = Panel(num)
J = Panel(num_2)

deplane = DeconstructPlane(Plane=pln)  # -> Origin, XAxis, YAxis, ZAxis
# Start manual jog at 150
amp = Amplitude(Vector=deplane.ZAxis, Amplitude=expr("-x", move_target_plane_up))
move = Move(Geometry=pln, Motion=amp)  # -> Geometry, Transform

# ----
# Goto a Frame
goto_robot_frame = Button()
pln_2 = Plane(move.Geometry)
deplane_2 = DeconstructPlane(Plane=pln_2)  # -> Origin, XAxis, YAxis, ZAxis
pt = ConstructPoint(XCoordinate="-400", YCoordinate="-600", ZCoordinate="2300")
move_2 = Move(Geometry=deplane_2.Origin, Motion=pt)  # -> Geometry, Transform
rougly_robotbase = Point(move_2.Geometry)
pdecon = Deconstruct(Point=rougly_robotbase)  # -> XComponent, YComponent, ZComponent
neg = Negative(Value=pdecon.ZComponent)
neg_2 = Negative(Value=pdecon.YComponent)
panel_3 = Panel("""0
0
0""")
merge = Merge(Data1=pdecon.XComponent, Data2=neg_2, Data3=neg, Data4=panel_3)
pln_3 = Plane(pln_2)
external_axes = Number(merge)
panel_4 = Panel(external_axes)
ghpython_script_2 = GhPythonScript(
    goto_robot_frame=goto_robot_frame,
    robot=ghpython_script.robot_11,
    frame=pln_3,
    external_axes=external_axes,
    speed=Slider(300, range=0..1000))  # -> out, external_axis, joints; inputs goto_robot_frame: Boolean, frame: Plane, external_axes: list
# ---------- ghpython_script_2: Python ----------
from scriptcontext import sticky as st
from compas_rrc import *
from compas_ghpython import draw_frame
from compas_rhino.geometry import RhinoPlane
# sticky prep function
def get_sticky(attribute_name):
    guid = str(ghenv.Component.InstanceGuid)
    sticky_key = guid + "_" + attribute_name
    if sticky_key not in st:
        st[sticky_key] = None
        return None
    else:
        return st[sticky_key]

def set_sticky(attribute_name, value):
    guid = str(ghenv.Component.InstanceGuid)
    sticky_key = guid + "_" + attribute_name
    st[sticky_key] = value

if goto_robot_frame:
    # Set Tool 0 in World 0
    robot.send(SetWorkObject('wobj0'))
    robot.send(SetTool('tool0'))
    
    # Go to target frame
    target_frame = RhinoPlane.from_geometry(frame).to_compas()
    ext_axes = ExternalAxes(*external_axes)
    robot.send(MoveToRobtarget(target_frame, ext_axes, speed, Zone.FINE, motion_type=Motion.LINEAR))
    
    # Get the finished pose Joint and external Values
    j, e = robot.send_and_wait(GetJoints(), timeout=10)
    if j is None:
        print ("Motion did not complete before Timeout 10 sec.")
    set_sticky('joints', j)
    set_sticky('external_axis', e)
if get_sticky('external_axis') is None:
    external_axis = None
    joints = None
else:
    external_axis = list(get_sticky('external_axis'))
    joints = list(get_sticky('joints'))
# ---------- end ghpython_script_2 ----------

move_target_plane_up_2 = Slider(0, range=0..1000)
pln_4 = Plane(pln_robot_frame)
Z = UnitZ(Factor=move_target_plane_up_2)
move_3 = Move(Geometry=pln_4, Motion=Z)  # -> Geometry, Transform

# ----
# Get Current Values
get_robot_frame = Button()
ghpython_script_3 = GhPythonScript(get_robot_frame=get_robot_frame, robot=ghpython_script.robot_11)  # -> out, external_axis, joints, frame; inputs get_robot_frame: Boolean
# ---------- ghpython_script_3: Python ----------
from scriptcontext import sticky as st
from compas_rrc import *
from compas_ghpython import draw_frame

# sticky prep function
def get_sticky(attribute_name):
    guid = str(ghenv.Component.InstanceGuid)
    sticky_key = guid + "_" + attribute_name
    if sticky_key not in st:
        st[sticky_key] = None
        return None
    else:
        return st[sticky_key]


def set_sticky(attribute_name, value):
    guid = str(ghenv.Component.InstanceGuid)
    sticky_key = guid + "_" + attribute_name
    st[sticky_key] = value

if get_robot_frame:
    # Set Tool 0 in World 0
    robot.send(SetWorkObject('wobj0'))
    robot.send(SetTool('tool0'))
    
    # get current robot pose
    f, e = robot.send_and_wait(GetRobtarget(), timeout=10)
    set_sticky('frame', f)

    j, e = robot.send_and_wait(GetJoints(), timeout=10)
    set_sticky('joints', j)
    set_sticky('external_axis', e)
    
frame = draw_frame(get_sticky('frame'))
external_axis = list(get_sticky('external_axis'))
joints = list(get_sticky('joints'))
# ---------- end ghpython_script_3 ----------
item = ListItem(List=ghpython_script_3.external_axis, Index=0, Wrap=True)  # -> Item, Item1, Item2
ea_2 = Panel(ghpython_script_3.external_axis)
neg_3 = Negative(Value=item.Item2)
neg_4 = Negative(Value=item.Item1)
pt_2 = ConstructPoint(XCoordinate=item.Item, YCoordinate=neg_4, ZCoordinate=neg_3)
J_2 = Panel(ghpython_script_3.joints)
rougly_robotbase_2 = Point(pt_2)

# ----
# Goto a Frame
goto_robot_frame_2 = Button()
pln_5 = Plane(move_3.Geometry)
ghpython_script_4 = GhPythonScript(
    goto_robot_frame=goto_robot_frame_2,
    robot=ghpython_script.robot_11,
    frame=pln_5,
    external_axes=ea,
    speed=Slider(10, range=0..1000))  # -> out, external_axis, joints; inputs goto_robot_frame: Boolean, frame: Plane, external_axes: list
# ---------- ghpython_script_4: Python ----------
from scriptcontext import sticky as st
from compas_rrc import *
from compas_ghpython import draw_frame
from compas_rhino.geometry import RhinoPlane
# sticky prep function
def get_sticky(attribute_name):
    guid = str(ghenv.Component.InstanceGuid)
    sticky_key = guid + "_" + attribute_name
    if sticky_key not in st:
        st[sticky_key] = None
        return None
    else:
        return st[sticky_key]

def set_sticky(attribute_name, value):
    guid = str(ghenv.Component.InstanceGuid)
    sticky_key = guid + "_" + attribute_name
    st[sticky_key] = value

if goto_robot_frame:
    # Set Tool 0 in World 0
    robot.send(SetWorkObject('wobj0'))
    robot.send(SetTool('tool0'))
    
    # Go to target frame
    target_frame = RhinoPlane.from_geometry(frame).to_compas()
    ext_axes = ExternalAxes(*external_axes)
    robot.send(MoveToRobtarget(target_frame, ext_axes, speed, Zone.FINE, motion_type=Motion.LINEAR))
    print (target_frame)
    print (ext_axes)
    # Get the finished pose Joint and external Values
    j, e = robot.send_and_wait(GetJoints(), timeout=10)
    if j is None:
        print ("Motion did not complete before Timeout 10 sec.")
    set_sticky('joints', j)
    set_sticky('external_axis', e)
if get_sticky('external_axis') is None:
    external_axis = None
    joints = None
else:
    external_axis = list(get_sticky('external_axis'))
    joints = list(get_sticky('joints'))
# ---------- end ghpython_script_4 ----------

merge_2 = Merge(
    Data1=flatten("# External Axis"),
    Data2=flatten(ghpython_script_3.external_axis),
    Data3=flatten("# Joint Values"),
    Data4=flatten(ghpython_script_3.joints))  # -> flatten(Result)

# ----
# Bake current Frame as two lines
pln_robot_frame_2 = Plane(ghpython_script_3.frame)
bake = Button()
pdecon_2 = Deconstruct(Point=pln_robot_frame_2)  # -> XComponent, YComponent, ZComponent
deplane_3 = DeconstructPlane(Plane=pln_robot_frame_2)  # -> Origin, XAxis, YAxis, ZAxis
merge_3 = Merge(Data1=deplane_3.XAxis, Data2=deplane_3.YAxis)
panel_5 = Panel("""x
y""")
line = LineSDL(Start=deplane_3.Origin, Direction=merge_3, Length=50)
createatts = CreateAttributes(Name=panel_5, enableFullPath=False)
bake_2 = BakeGeometry(Bake=bake, Geometry=line, Attributes=createatts, DeleteOldBakes=False, PreserveTrees=False)

ea_3 = Panel(merge_2)
