# Grasshopper definition igps_points_RFL_ITJ.gh (Grasshopper 1.0.7)

probe1 = Panel("""11:39:25	25379.713;6141.539;244.313
11:39:25	25379.713;6141.539;244.313
11:39:25	25379.713;6141.539;244.313
11:39:25	25379.713;6141.539;244.313
11:39:25	25379.719;6141.533;244.314
11:39:29	25348.370;6206.442;244.468
11:39:29	25348.377;6206.440;244.473
11:39:30	25348.391;6206.443;244.479
11:39:30	25348.391;6206.443;244.479
11:39:30	25348.395;6206.444;244.483
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""")
panel = Panel("""15:07:54	24346.823;9140.319;268.882
15:07:54	24346.823;9140.319;268.882
15:07:55	24346.838;9140.317;268.860
15:07:55	24346.838;9140.317;268.860
15:07:55	24346.837;9140.324;268.843
15:07:55	24346.837;9140.324;268.843
15:07:55	24346.837;9140.324;268.843
15:07:55	24346.837;9140.324;268.843
15:07:55	24346.842;9140.316;268.825
15:07:55	24346.842;9140.316;268.825
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""")
python = PythonScript(str_list=probe1)  # -> points; inputs str_list: list
# ---------- python: Python ----------
import Rhino.Geometry as rg

points = []

for line in str_list:
    tabs = line.split("\t")
    
    values = tabs[1].split(";")
    
    pt = rg.Point3d( float(values[0]), float(values[1]), float(values[2]) )
    
    if pt.X != 0.0 and pt.Y != 0.0 and pt.Z != 0.0:
        points.append(pt)
# ---------- end python ----------
python_2 = PythonScript(str_list=panel)  # -> points; inputs str_list: list; same code as python
points = Data(python)
points_2 = Data(python_2)
ghpython_script = GhPythonScript(igps_points=points)  # -> robotworld_points; inputs igps_points: list of Point3d
# ---------- ghpython_script: Python ----------
import compas.geometry as cg
import ghpythonlib.components as ghcomp
import Rhino.Geometry as rg
from compas_ghpython import draw_frame



# iGPS world - Robot worls offsets
robot_11_igps_wobj0 = ((-2614.766, -2058.444, 29.420), (1.0, -0.000028, 0.000047, -0.000034))
robot_12_igps_wobj0 = ((-2609.441, -2057.051, 28.106), (1.0, -0.000026, -0.000042, 0.000059))


def transf(obj, rg_T, cg_T):
    if isinstance(obj, rg.Plane):
        return ghcomp.Transform(obj, rg_T)

    elif isinstance(obj, rg.Brep):
        return ghcomp.Transform(obj, rg_T)

    elif isinstance(obj, rg.Mesh):
        return ghcomp.Transform(obj, rg_T)

    elif isinstance(obj, rg.Point3d):
        return ghcomp.Transform(obj, rg_T)

    elif "compas" in str(type(obj)):
        return obj.transformed(cg_T)

    else:
        raise NotImplementedError


def iGPSWorld_to_RobotWorld(obj, robot="robot_11"):

    if robot == "robot_11":
        robot_igps_wobj0 = robot_11_igps_wobj0
    elif robot == "robot_12":
        robot_igps_wobj0 = robot_12_igps_wobj0
    else:
        raise NotImplementedError

    # iGPSworld to RobotWorld transformation
    rg_iGPS_to_robot_world_vector = rg.Vector3d(*robot_igps_wobj0[0])
    
    
    
    
    to_frame = cg.Frame.from_quaternion(robot_11_igps_wobj0[1], point=robot_11_igps_wobj0[0])
    to_plane = draw_frame(to_frame)
    
    rg_iGPS_to_robot_world_T = rg.Transform.PlaneToPlane(rg.Plane.WorldXY, to_plane)
    
    cg_iGPS_to_robot_world_T = None
    """
    cg_iGPS_to_robot_world_T = cg.Transformation.from_matrix([
        [1, 0, 0, rg_iGPS_to_robot_world_vector.X],
        [0, 1, 0, rg_iGPS_to_robot_world_vector.Y],
        [0, 0, 1, rg_iGPS_to_robot_world_vector.Z],
        [0, 0, 0, 1]])
        """

    if isinstance(obj, list):
        # print " --- iGPSWorld_to_RobotWorld for list"
        return [transf(item, rg_iGPS_to_robot_world_T, cg_iGPS_to_robot_world_T) for item in obj]
    elif obj is None:
        # print " --- iGPSWorld_to_RobotWorld for none"
        return None
    else:
        # print " --- iGPSWorld_to_RobotWorld for single object"
        return transf(obj, rg_iGPS_to_robot_world_T, cg_iGPS_to_robot_world_T)


def RobotWorld_to_iGPSWorld(obj, robot="robot_11"):

    if robot == "robot_11":
        robot_igps_wobj0 = robot_11_igps_wobj0
    elif robot == "robot_12":
        robot_igps_wobj0 = robot_12_igps_wobj0
    else:
        raise NotImplementedError

    # RobotWorld to iGPSworld transformation
    rg_robot_world_to_iGPS_vector = -rg.Vector3d(*robot_igps_wobj0[0])
    rg_robot_to_igps_world_T = rg.Transform.Translation(rg_robot_world_to_iGPS_vector)
    cg_robot_to_igps_world_T = cg.Transformation.from_matrix(
        [[1, 0, 0, rg_robot_world_to_iGPS_vector.X],
         [0, 1, 0, rg_robot_world_to_iGPS_vector.Y],
         [0, 0, 1, rg_robot_world_to_iGPS_vector.Z],
         [0, 0, 0, 1]])

    if isinstance(obj, list):
        # print " --- RobotWorld to iGPSworld for list"
        return [transf(item, rg_robot_to_igps_world_T, cg_robot_to_igps_world_T) for item in obj]
    elif obj is None:
        # print " --- RobotWorld to iGPSworld for none"
        return None
    else:
        # print " --- RobotWorld to iGPSworld for single object"
        return transf(obj, rg_robot_to_igps_world_T, cg_robot_to_igps_world_T)



robotworld_points = iGPSWorld_to_RobotWorld(igps_points)
# ---------- end ghpython_script ----------
ghpython_script_2 = GhPythonScript(igps_points=points_2)  # -> robotworld_points; inputs igps_points: list of Point3d; same code as ghpython_script
data = Data(ghpython_script)
data_2 = Data(points_2)

# ----
# Gripper Storage
pt = Point([<point referenced from the Rhino model> x14])
pt_2 = Point([<point referenced from the Rhino model> x6])
plfit = PlaneFit(Points=pt)  # -> Plane, Deviation
avr = Average(Input=pt)
plfit_2 = PlaneFit(Points=pt_2)  # -> Plane, Deviation
avr_2 = Average(Input=pt_2)
angle = Angle()  # -> Angle, Reflex
deg = Degrees(Radians=angle.Angle)
# main = large face
# x = long side
# y = short side
angle_difference = Panel(deg)

# ----
# Clamp Storage
pt_3 = Point([<point referenced from the Rhino model> x21])
pt_4 = Point([<point referenced from the Rhino model> x5])
plfit_3 = PlaneFit(Points=pt_3)  # -> Plane, Deviation
avr_3 = Average(Input=pt_3)
plfit_4 = PlaneFit(Points=pt_4)  # -> Plane, Deviation
avr_4 = Average(Input=pt_4)
angle_2 = Angle()  # -> Angle, Reflex
deg_2 = Degrees(Radians=angle_2.Angle)
angle_difference_2 = Panel(deg_2)
