# Grasshopper definition FrameSetOut.gh (Grasshopper 1.0.7)

yz = YZPlane(Origin=Point(0, 0, 0))
crv = Curve([<curve referenced from the Rhino model> x2])
offset = OffsetCurve(Curve=crv, Distance=Slider(120, range=0..1000), Plane=yz, Corners=1)
loft = Loft(Curves=offset, Options={Adjust=False, Closed=False, LoftEnds=0, LoftSimp=0, LoftType=0, Rebuild=10, Refit=0.01})
