# Grasshopper definition FrameSetout3_PurlinAwayFromBeam.gh (Grasshopper 1.0.7)

crv = Curve(<curve referenced from the Rhino model>)
# Roof Adjustment: - Main Beam Slope - 4 Corner Height
# - Purlin Height - proper join with Beams
# - Trim Column at Beam Top - 6 pcs
# - Trim Perlin Ends
series = Series(Start=0, Step=Slider(700, range=0..1000), Count=Slider(7, range=0..100))
Y = UnitY(Factor=series)
move = Move(Geometry=crv, Motion=Y)  # -> Geometry, Transform

setting_out = Curve([<curve referenced from the Rhino model> x9])

width = Slider(100, range=0..100)
yz = YZPlane(Origin=Point(0, 0, 0))
# Base Horizontal
crv_2 = Curve([<curve referenced from the Rhino model> x3])
height = Slider(120, range=0..1000)
xz = XZPlane(Origin=Point(0, 0, 0))
deplane = DeconstructPlane(Plane=xz)  # -> Origin, XAxis, YAxis, ZAxis

# ----
# Height Control
height_control = Curve(<curve referenced from the Rhino model>)
height_control_2 = Curve(<curve referenced from the Rhino model>)
setting_out_2 = Curve([<curve referenced from the Rhino model> x8])
end = EndPoints(Curve=setting_out_2)  # -> Start, End
vec2pt = Vector2Pt(PointA=end.Start, PointB=end.End, Unitize=False)  # -> Vector, Length
Z = UnitZ(Factor=1)
pl = ConstructPlane(Origin=end.Start, XAxis=vec2pt.Vector, YAxis=Z)
pcx = CurvePlane(Curve=height_control, Plane=pl)  # -> Points, ParamsC, ParamsP
pcx_2 = CurvePlane(Curve=height_control_2, Plane=pl)  # -> Points, ParamsC, ParamsP
ln = Line(StartPoint=pcx.Points, EndPoint=pcx_2.Points)

# ----
# Bottom Trim
bottom_trim = Curve(<curve referenced from the Rhino model>)
bottom_trim_2 = Curve(<curve referenced from the Rhino model>)
clx = CurveLine(Curve=bottom_trim_2, Line=setting_out_2)  # -> Points, Params, Count
clx_2 = CurveLine(Curve=bottom_trim, Line=setting_out_2)  # -> Points, Params, Count
Z_2 = UnitZ(Factor=1)
line = LineSDL(Start=clx_2.Points, Direction=Z_2, Length=6000)
line_2 = LineSDL(Start=clx.Points, Direction=Z_2, Length=6000)

yz_2 = YZPlane(Origin=Point(0, 0, 0))
xz_2 = XZPlane(Origin=Point(0, 0, 0))
width_2 = Slider(100, range=0..100)
# Base Columns
crv_3 = Curve([<curve referenced from the Rhino model> x6])
height_2 = Slider(100, range=0..1000)
deplane_2 = DeconstructPlane(Plane=xz_2)  # -> Origin, XAxis, YAxis, ZAxis

xy = XYPlane(Origin=Point(0, 0, 0))

division = Division(A=height_2, B=2)
offset = OffsetCurve(Curve=crv_3, Distance=expr("-x", division), Plane=xz_2, Corners=1)
offset_2 = OffsetCurve(Curve=crv_3, Distance=division, Plane=xz_2, Corners=1)
merge = Merge(Data1=offset, Data2=offset_2)

offset_3 = OffsetCurve(Curve=crv_2, Distance=1, Plane=xz, Corners=1)
offset_4 = OffsetCurve(Curve=crv_2, Distance=height, Plane=xz, Corners=1)
merge_2 = Merge(Data1=offset_3, Data2=offset_4)

# ----
# Bottom Trim
bottom_trim_3 = Curve(<curve referenced from the Rhino model>)
bottom_trim_4 = Curve(<curve referenced from the Rhino model>)
clx_3 = CurveLine(Curve=bottom_trim_4, Line=setting_out)  # -> Points, Params, Count
clx_4 = CurveLine(Curve=bottom_trim_3, Line=setting_out)  # -> Points, Params, Count
Z_3 = UnitZ(Factor=1)
line_3 = LineSDL(Start=clx_4.Points, Direction=Z_3, Length=6000)
line_4 = LineSDL(Start=clx_3.Points, Direction=Z_3, Length=6000)

# ----
# Height Control
height_control_3 = Curve(<curve referenced from the Rhino model>)
height_control_4 = Curve(<curve referenced from the Rhino model>)
crv_4 = Curve(setting_out)
end_2 = EndPoints(Curve=crv_4)  # -> Start, End
vec2pt_2 = Vector2Pt(PointA=end_2.Start, PointB=end_2.End, Unitize=False)  # -> Vector, Length
ext = ExtendCurve(Curve=height_control_3, Type=2, Start=2000, End=2000)
ext_2 = ExtendCurve(Curve=height_control_4, Type=2, Start=2000, End=2000)
Z_4 = UnitZ(Factor=1)
pl_2 = ConstructPlane(Origin=end_2.Start, XAxis=vec2pt_2.Vector, YAxis=Z_4)
pcx_3 = CurvePlane(Curve=ext, Plane=pl_2)  # -> Points, ParamsC, ParamsP
pcx_4 = CurvePlane(Curve=ext_2, Plane=pl_2)  # -> Points, ParamsC, ParamsP
ln_2 = Line(StartPoint=pcx_3.Points, EndPoint=pcx_4.Points)  # -> simplify(graft(Line))

division_2 = Division(A=width, B=2)
amp = Amplitude(Vector=deplane.ZAxis, Amplitude=division_2)
rev = Reverse(Vector=amp)
move_2 = Move(Geometry=merge_2, Motion=rev)  # -> Geometry, Transform

amp_2 = Amplitude(Vector=deplane.ZAxis, Amplitude=width)
loft = Loft(Curves=move_2.Geometry, Options={Adjust=False, Closed=False, LoftEnds=0, LoftSimp=0, LoftType=0, Rebuild=10, Refit=0.01})
extr = Extrude(Base=loft, Direction=amp_2)

division_3 = Division(A=width_2, B=2)
amp_3 = Amplitude(Vector=deplane_2.ZAxis, Amplitude=division_3)
rev_2 = Reverse(Vector=amp_3)
move_3 = Move(Geometry=merge, Motion=rev_2)  # -> Geometry, Transform

amp_4 = Amplitude(Vector=deplane_2.ZAxis, Amplitude=width_2)
loft_2 = Loft(Curves=move_3.Geometry, Options={Adjust=False, Closed=False, LoftEnds=0, LoftSimp=0, LoftType=0, Rebuild=10, Refit=0.01})
extr_2 = Extrude(Base=loft_2, Direction=amp_4)

# ----
# Trim Planes
eval = EvaluateCurve(Curve=bottom_trim_4, Parameter=clx_3.Params)  # -> Point, Tangent, Angle
eval_2 = EvaluateCurve(Curve=bottom_trim_3, Parameter=clx_4.Params)  # -> Point, Tangent, Angle
Z_5 = UnitZ(Factor=1)
pl_3 = ConstructPlane(Origin=eval.Point, XAxis=Z_5, YAxis=eval.Tangent)
pl_4 = ConstructPlane(Origin=eval_2.Point, XAxis=Z_5, YAxis=eval_2.Tangent)

width_3 = Slider(100, range=0..100)
yz_3 = YZPlane(Origin=Point(0, 0, 0))
xz_3 = XZPlane(Origin=Point(0, 0, 0))
crv_5 = Curve([<curve referenced from the Rhino model> x2])
height_3 = Slider(120, range=0..1000)
deplane_3 = DeconstructPlane(Plane=yz_3)  # -> Origin, XAxis, YAxis, ZAxis

# ----
# Base Line
llx = LineLine(Line1=line, Line2=ln)  # -> ParamA, ParamB, PointA, PointB
llx_2 = LineLine(Line1=line_2, Line2=ln)  # -> ParamA, ParamB, PointA, PointB
ln_3 = Line(StartPoint=llx.PointA, EndPoint=llx_2.PointA)

# ----
# Untrimmed
ext_3 = ExtendCurve(Curve=ln_3, Type=0, Start=300, End=300)
yz_4 = YZPlane(Origin=Point(0, 0, 0))
xz_4 = XZPlane(Origin=Point(0, 0, 0))
height_4 = Slider(120, range=0..1000)
width_4 = Slider(100, range=0..100)
crv_6 = Curve(ext_3)
deplane_4 = DeconstructPlane(Plane=xz_4)  # -> Origin, XAxis, YAxis, ZAxis

offset_5 = OffsetCurve(Curve=crv_6, Distance=1, Plane=xz_4, Corners=1)
offset_6 = OffsetCurve(Curve=crv_6, Distance=height_4, Plane=xz_4, Corners=1)
merge_3 = Merge(Data1=offset_5, Data2=offset_6)

division_4 = Division(A=width_4, B=2)
amp_5 = Amplitude(Vector=deplane_4.ZAxis, Amplitude=division_4)
rev_3 = Reverse(Vector=amp_5)
move_4 = Move(Geometry=merge_3, Motion=rev_3)  # -> Geometry, Transform

amp_6 = Amplitude(Vector=deplane_4.ZAxis, Amplitude=width_4)
loft_3 = Loft(Curves=move_4.Geometry, Options={Adjust=False, Closed=False, LoftEnds=0, LoftSimp=0, LoftType=0, Rebuild=10, Refit=0.01})
extr_3 = Extrude(Base=loft_3, Direction=amp_6)

offset_7 = OffsetCurve(Curve=crv_5, Distance=1, Plane=yz_3, Corners=1)
offset_8 = OffsetCurve(Curve=crv_5, Distance=height_3, Plane=yz_3, Corners=1)
merge_4 = Merge(Data1=offset_7, Data2=offset_8)

llx_3 = LineLine(Line1=line_3, Line2=ln_2)  # -> ParamA, ParamB, PointA, PointB
llx_4 = LineLine(Line1=line_4, Line2=ln_2)  # -> ParamA, ParamB, PointA, PointB
ln_4 = Line(StartPoint=llx_3.PointA, EndPoint=llx_4.PointA)

# ----
# Untrimmed
ext_4 = ExtendCurve(Curve=ln_4, Type=0, Start=300, End=300)
yz_5 = YZPlane(Origin=Point(0, 0, 0))
xz_5 = XZPlane(Origin=Point(0, 0, 0))
width_5 = Slider(100, range=0..100)
height_5 = Slider(100, range=0..1000)
crv_7 = Curve(ext_4)
deplane_5 = DeconstructPlane(Plane=yz_5)  # -> Origin, XAxis, YAxis, ZAxis

offset_9 = OffsetCurve(Curve=crv_7, Distance=1, Plane=yz_5, Corners=1)
offset_10 = OffsetCurve(Curve=crv_7, Distance=height_5, Plane=yz_5, Corners=1)
merge_5 = Merge(Data1=offset_9, Data2=offset_10)

division_5 = Division(A=width_5, B=2)
amp_7 = Amplitude(Vector=deplane_5.ZAxis, Amplitude=division_5)
rev_4 = Reverse(Vector=amp_7)
move_5 = Move(Geometry=merge_5, Motion=rev_4)  # -> Geometry, Transform

amp_8 = Amplitude(Vector=deplane_5.ZAxis, Amplitude=width_5)
loft_4 = Loft(Curves=move_5.Geometry, Options={Adjust=False, Closed=False, LoftEnds=0, LoftSimp=0, LoftType=0, Rebuild=10, Refit=0.01})
extr_4 = Extrude(Base=loft_4, Direction=amp_8)

division_6 = Division(A=width_3, B=2)
amp_9 = Amplitude(Vector=deplane_3.ZAxis, Amplitude=division_6)
rev_5 = Reverse(Vector=amp_9)
move_6 = Move(Geometry=merge_4, Motion=rev_5)  # -> Geometry, Transform

amp_10 = Amplitude(Vector=deplane_3.ZAxis, Amplitude=width_3)
loft_5 = Loft(Curves=move_6.Geometry, Options={Adjust=False, Closed=False, LoftEnds=0, LoftSimp=0, LoftType=0, Rebuild=10, Refit=0.01})
extr_5 = Extrude(Base=loft_5, Direction=amp_10)

# ----
# Trimmed
sec = BrepPlane(Brep=extr_4, Plane=pl_4)  # -> Curves, Points
sec_2 = BrepPlane(Brep=extr_4, Plane=pl_3)  # -> Curves, Points
merge_6 = Merge(Data1=sec.Curves, Data2=sec_2.Curves)
loft_6 = Loft(Curves=merge_6, Options={Adjust=False, Closed=False, LoftEnds=0, LoftSimp=0, LoftType=0, Rebuild=10, Refit=0.01})
cap = CapHoles(Brep=loft_6)

# ----
# Main Beams
yz_6 = YZPlane(Origin=Point(0, 0, 0))
width_6 = Slider(100, range=0..100)
crv_8 = Curve([<curve referenced from the Rhino model> x2])
height_6 = Slider(140, range=0..1000)
deplane_6 = DeconstructPlane(Plane=yz_6)  # -> Origin, XAxis, YAxis, ZAxis

# ----
# Bottom Trim
bottom_trim_5 = Curve(<curve referenced from the Rhino model>)
bottom_trim_6 = Curve(<curve referenced from the Rhino model>)
end_3 = EndPoints(Curve=bottom_trim_5)  # -> Start, End
end_4 = EndPoints(Curve=bottom_trim_6)  # -> Start, End
vec2pt_3 = Vector2Pt(PointA=end_3.Start, PointB=end_3.End, Unitize=False)  # -> Vector, Length
vec2pt_4 = Vector2Pt(PointA=end_4.Start, PointB=end_4.End, Unitize=False)  # -> Vector, Length
Z_6 = UnitZ(Factor=1)
pl_5 = ConstructPlane(Origin=end_3.Start, XAxis=vec2pt_3.Vector, YAxis=Z_6)
pl_6 = ConstructPlane(Origin=end_4.Start, XAxis=vec2pt_4.Vector, YAxis=Z_6)

offset_11 = OffsetCurve(Curve=crv_8, Distance=1, Plane=yz_6, Corners=1)
offset_12 = OffsetCurve(Curve=crv_8, Distance=height_6, Plane=yz_6, Corners=1)
merge_7 = Merge(Data1=offset_11, Data2=offset_12)

# ----
# Beam Plane for Triming
number_slider = Slider(25, range=0..1000)
end_5 = EndPoints(Curve=offset_12)  # -> Start, End
vec2pt_5 = Vector2Pt(PointA=end_5.Start, PointB=end_5.End, Unitize=False)  # -> Vector, Length
pl_7 = ConstructPlane(Origin=end_5.Start, XAxis=vec2pt_5.Vector, YAxis=deplane_6.ZAxis)
pl_offset = PlaneOffset(BasePlane=pl_7, Offset=number_slider)
split = SplitList(List=flatten(pl_offset), Index=1)  # -> graft(ListA), graft(ListB)

division_7 = Division(A=width_6, B=2)
amp_11 = Amplitude(Vector=deplane_6.ZAxis, Amplitude=division_7)
rev_6 = Reverse(Vector=amp_11)
move_7 = Move(Geometry=merge_7, Motion=rev_6)  # -> Geometry, Transform

amp_12 = Amplitude(Vector=deplane_6.ZAxis, Amplitude=width_6)
loft_7 = Loft(Curves=move_7.Geometry, Options={Adjust=False, Closed=False, LoftEnds=0, LoftSimp=0, LoftType=0, Rebuild=10, Refit=0.01})
extr_6 = Extrude(Base=loft_7, Direction=amp_12)

# ----
# Trimmed
sec_3 = BrepPlane(Brep=extr_6, Plane=pl_6)  # -> Curves, Points
sec_4 = BrepPlane(Brep=extr_6, Plane=pl_5)  # -> Curves, Points
merge_8 = Merge(Data1=sec_3.Curves, Data2=sec_4.Curves)
loft_8 = Loft(Curves=merge_8, Options={Adjust=False, Closed=False, LoftEnds=0, LoftSimp=0, LoftType=0, Rebuild=10, Refit=0.01})
cap_2 = CapHoles(Brep=loft_8)

yz_7 = YZPlane(Origin=Point(0, 0, 0))
xz_6 = XZPlane(Origin=Point(0, 0, 0))
width_7 = Slider(100, range=0..100)
# Wall Columns
crv_9 = Curve([<curve referenced from the Rhino model> x3])
height_7 = Slider(100, range=0..1000)
deplane_7 = DeconstructPlane(Plane=xz_6)  # -> Origin, XAxis, YAxis, ZAxis

xy_2 = XYPlane(Origin=Point(0, 0, 0))

division_8 = Division(A=height_7, B=2)
offset_13 = OffsetCurve(Curve=crv_9, Distance=expr("-x", division_8), Plane=xz_6, Corners=1)
offset_14 = OffsetCurve(Curve=crv_9, Distance=division_8, Plane=xz_6, Corners=1)
merge_9 = Merge(Data1=offset_13, Data2=offset_14)

division_9 = Division(A=width_7, B=2)
amp_13 = Amplitude(Vector=deplane_7.ZAxis, Amplitude=division_9)
rev_7 = Reverse(Vector=amp_13)
move_8 = Move(Geometry=merge_9, Motion=rev_7)  # -> Geometry, Transform

amp_14 = Amplitude(Vector=deplane_7.ZAxis, Amplitude=width_7)
loft_9 = Loft(Curves=move_8.Geometry, Options={Adjust=False, Closed=False, LoftEnds=0, LoftSimp=0, LoftType=0, Rebuild=10, Refit=0.01})
extr_7 = Extrude(Base=loft_9, Direction=amp_14)

sec_5 = BrepPlane(Brep=extr_7, Plane=split.ListA)  # -> Curves, Points
Z_7 = UnitZ(Factor=1000)
extr_8 = Extrude(Base=sec_5.Curves, Direction=Z_7)
cap_3 = CapHoles(Brep=extr_8)
sdiff = SolidDifference(BrepsA=extr_7, BrepsB=cap_3)

# ----
# Rafter
eval_3 = EvaluateCurve(Curve=bottom_trim_2, Parameter=clx.Params)  # -> Point, Tangent, Angle
eval_4 = EvaluateCurve(Curve=bottom_trim, Parameter=clx_2.Params)  # -> Point, Tangent, Angle
Z_8 = UnitZ(Factor=1)
pl_8 = ConstructPlane(Origin=eval_3.Point, XAxis=Z_8, YAxis=eval_3.Tangent)
pl_9 = ConstructPlane(Origin=eval_4.Point, XAxis=Z_8, YAxis=eval_4.Tangent)

# ----
# Trimmed
sec_6 = BrepPlane(Brep=extr_3, Plane=pl_9)  # -> Curves, Points
sec_7 = BrepPlane(Brep=extr_3, Plane=pl_8)  # -> Curves, Points
merge_10 = Merge(Data1=sec_6.Curves, Data2=sec_7.Curves)
loft_10 = Loft(Curves=merge_10, Options={Adjust=False, Closed=False, LoftEnds=0, LoftSimp=0, LoftType=0, Rebuild=10, Refit=0.01})
cap_4 = CapHoles(Brep=loft_10)

trimmed_brep = Brep(cap_4)

sint = SolidIntersection(BrepsA=flatten(cap_2), BrepsB=trimmed_brep)  # -> flatten(Result)
number_slider_2 = Slider(641589, range=0..1000000)
number_slider_3 = Slider(200000, range=0..1000000)
volume = Volume(Geometry=sint)  # -> Volume, Centroid
subtraction = Subtraction(A=number_slider_2, B=number_slider_3)
addition = Addition(A=number_slider_2, B=number_slider_3)
gradient = Gradient(
    LowerLimit=subtraction,
    UpperLimit=addition,
    Parameter=volume.Volume,
    stops=[0: RGB(252, 128, 215), 0.5: RGB(0, 255, 0), 1: RGB(255, 0, 0)])
preview = CustomPreview(Geometry=sint, Material=gradient)

bbx = BrepBrep(BrepA=flatten(cap_2), BrepB=trimmed_brep)  # -> Curves, Points

sint_2 = SolidIntersection(BrepsA=flatten(trimmed_brep), BrepsB=cap)  # -> flatten(Result)
bbx_2 = BrepBrep(BrepA=flatten(trimmed_brep), BrepB=cap)  # -> Curves, Points
number_slider_4 = Slider(500000, range=0..1000000)
number_slider_5 = Slider(200000, range=0..1000000)
volume_2 = Volume(Geometry=sint_2)  # -> Volume, Centroid
subtraction_2 = Subtraction(A=number_slider_4, B=number_slider_5)
addition_2 = Addition(A=number_slider_4, B=number_slider_5)
gradient_2 = Gradient(
    LowerLimit=subtraction_2,
    UpperLimit=addition_2,
    Parameter=volume_2.Volume,
    stops=[0: RGB(252, 128, 215), 0.5: RGB(0, 255, 0), 1: RGB(255, 0, 0)])
preview_2 = CustomPreview(Geometry=sint_2, Material=gradient_2)

# ----
# Columns Trim
split_2 = SplitList(List=flatten(extr_2), Index=3)  # -> graft(ListA), graft(ListB)
crv_10 = Curve(<curve referenced from the Rhino model>)  # disabled
crv_11 = Curve(<curve referenced from the Rhino model>)  # disabled
explode = Explode(Curve=crv_10, Recursive=True)  # -> Segments, Vertices; disabled
explode_2 = Explode(Curve=crv_11, Recursive=True)  # -> Segments, Vertices; disabled
item = ListItem(List=explode.Vertices, Index=0, Wrap=True)  # -> Item, Item1, Item2; disabled
item_2 = ListItem(List=explode_2.Vertices, Index=0, Wrap=True)  # -> Item, Item1, Item2; disabled
pl_3pt = Plane3Pt(PointA=item.Item1, PointB=item.Item, PointC=item.Item2)  # disabled
pl_3pt_2 = Plane3Pt(PointA=item_2.Item1, PointB=item_2.Item, PointC=item_2.Item2)  # disabled
sec_8 = BrepPlane(Brep=split_2.ListB, Plane=split.ListB)  # -> Curves, Points
sec_9 = BrepPlane(Brep=split_2.ListA, Plane=split.ListA)  # -> Curves, Points

Z_9 = UnitZ(Factor=1000)
Z_10 = UnitZ(Factor=1000)
extr_9 = Extrude(Base=sec_8.Curves, Direction=Z_9)
extr_10 = Extrude(Base=sec_9.Curves, Direction=Z_10)

cap_5 = CapHoles(Brep=extr_9)
cap_6 = CapHoles(Brep=extr_10)
sdiff_2 = SolidDifference(BrepsA=split_2.ListA, BrepsB=cap_6)
sdiff_3 = SolidDifference(BrepsA=split_2.ListB, BrepsB=cap_5)
