# Grasshopper definition robot_trajectory_visualize.gh (Grasshopper 1.0.7)
# plug-ins: MetaHopper, Kangaroo2 Components

# ----
# Auto-locate repo submodule
rhino_doc_dir = RhinoDocDir()  # -> rhino_doc_dir
# ---------- rhino_doc_dir: Python ----------
import scriptcontext as sc
from os import path

rhino_doc_dir = path.abspath(path.dirname(sc.doc.Path))
# ---------- end rhino_doc_dir ----------
ghpython_script = GhPythonScript(current_path=rhino_doc_dir)  # -> out, path
# ---------- ghpython_script: Python ----------
import os

path = os.path.abspath(os.path.join(current_path, '..', '..', 'itj_design_study', 
    '210128_RemodelFredPavilion'))
# ---------- end ghpython_script ----------
ghpython_script_2 = GhPythonScript(current_path=rhino_doc_dir)  # -> out, path
# ---------- ghpython_script_2: Python ----------
import os

path = os.path.abspath(os.path.join(current_path, '..', '..',))
# ---------- end ghpython_script_2 ----------
concatenate = Concatenate(Fragment_A=rhino_doc_dir, Fragment_B="\", C="results", A="\", B="Shelter_process.json")

perform_polyline_check = BooleanToggle(False)

path_containing_the_rfl_description_pack = Panel(ghpython_script_2.path)  # "Path containing the rfl_description package"
full_path_of_the_process_json_with_plann = Panel(concatenate)  # "Full Path of the Process JSON with planned path"
urdf_file_name = Panel("rfl_pybullet.urdf")
rfl_description_package_name = Panel("rfl_description")
srdf_file_name = Panel("rfl.srdf")

# ----
# Development Tools
# Reload Python Modules (if Module Code is Changed)
python_module_to_reload = Panel("""compas
compas_fab
roslibpy
integral_timber_joints""")
reload = Button()
py = PythonScript(reload_module_button=reload, module_names=python_module_to_reload)  # inputs module_names: list
# ---------- py: Python ----------
import compas_ghpython
from compas_ghpython import unload_modules
if reload_module_button:
    for module in module_names:
        unload_modules(module)
# ---------- end py ----------

# ----
# Check Path and Environment
compas_version = GhPythonScript()  # -> out, compas_version, compas_fab_version, compas_path, compas_fab_path, compas_env_name, python_directory
# ---------- compas_version: Python ----------
__author__ = "leungp"
__version__ = "2020.04.20"

import rhinoscriptsyntax as rs
import compas
import compas_fab
compas_version  = compas.__version__
compas_fab_version = compas_fab.__version__
import os
compas_path = os.path.abspath(compas.__file__)
compas_fab_path = os.path.abspath(compas_fab.__file__)

import compas_bootstrapper
compas_env_name = compas_bootstrapper.ENVIRONMENT_NAME
python_directory = compas_bootstrapper.PYTHON_DIRECTORY
# ---------- end compas_version ----------
compas_environment_name = Panel(compas_version.compas_env_name)
compas_version_2 = Panel(compas_version.compas_version)
compas_fab_version = Panel(compas_version.compas_fab_version)
compas_path = Panel(compas_version.compas_path)
compas_fab_path = Panel(compas_version.compas_fab_path)
python_directory = Panel(compas_version.python_directory)

# ----
# Load Robot
load = Button()
ghpython_script_3 = PythonScript(
    load=load,
    pkg_path=path_containing_the_rfl_description_pack,
    pkg_name=rfl_description_package_name,
    urdf_file=urdf_file_name,
    srdf_file=srdf_file_name)  # -> out, robot
# ---------- ghpython_script_3: Python ----------
from scriptcontext import sticky as st
import os
import compas

from compas.robots import RobotModel
from compas.robots import GithubPackageMeshLoader
from compas.robots import LocalPackageMeshLoader
from compas_fab.robots import Robot
from compas_fab.robots import RobotSemantics
from compas_ghpython.artists import RobotModelArtist

# Robot meshes are usually in meters
# Set a high percision to prevent parsing errors
# and configure Rhino itself in meters
compas.PRECISION = '12f'

# Store robot in component-based key
robot_key = 'robot_{}'.format(str(ghenv.Component.InstanceGuid))

if robot_key not in st:
    st[robot_key] = None

if load:
    # Also load geometry
    loader = LocalPackageMeshLoader(os.path.join(pkg_path, 'rfl_description'), pkg_name)
    abb_loader = LocalPackageMeshLoader(os.path.join(pkg_path), "abb_irb4600_40_255")
    
    # Create robot model from URDF
    model = RobotModel.from_urdf_string(loader.load_urdf(urdf_file).read())
    model.load_geometry(loader, abb_loader)

    artist = RobotModelArtist(model)
    
    robot_semantics = None
    if srdf_file:
        robot_semantics = RobotSemantics.from_srdf_file(loader.build_path('urdf', srdf_file), model)
    
    robot = Robot(model, artist, semantics=robot_semantics)
#    robot.scale(1000)
    st[robot_key] = robot

robot = st[robot_key]

#repo    = 'ros-industrial/abb'
#package = 'abb_irb6600_support'
#branch  = 'kinetic-devel'
#
#github = GithubPackageMeshLoader(repo, package, branch)
#
#model = RobotModel.from_urdf_file(github.load_urdf('irb6640.urdf'))
#model.load_geometry(github)
#artist = RobotModelArtist(model)
#robot = Robot(model, artist)
# ---------- end ghpython_script_3 ----------
robot = Data(ghpython_script_3.robot)

# ----
# Load Process
panel = Panel("robot11_eaXYZ")
load_2 = Button()
ghpython_script_4 = PythonScript(load=load_2, process_path=full_path_of_the_process_json_with_plann, robot_group_name=panel)  # -> out, process
# ---------- ghpython_script_4: Python ----------
from scriptcontext import sticky as st
import compas
import json
import os
from compas.utilities import DataDecoder, DataEncoder

# Robot meshes are usually in meters
# Set a high percision to prevent parsing errors
# and configure Rhino itself in meters
compas.PRECISION = '12f'

# Store robot in component-based key
process_key = 'process_{}'.format(str(ghenv.Component.InstanceGuid))

if process_key not in st:
    st[process_key] = None

if load:
    with open(process_path, 'r') as f:
        process = json.load(f, cls=DataDecoder)
    external_m = process.load_external_movements(os.path.dirname(process_path))
    process.robot_group_name = robot_group_name
    st[process_key] = process

process = st[process_key]
# ---------- end ghpython_script_4 ----------

panel_2 = Panel(ghpython_script_3.out)
prismatic_joint_tolerance_m = Slider(0.05, range=0..0.1)
prismatic_joint_tolerance_deg = Slider(10, range=0..20)
rad = Radians(Degrees=prismatic_joint_tolerance_deg)

# ----
# Grasp Information
panel_3 = Panel("1005")  # disabled
panel_4 = Panel("505")  # disabled
beam_pickup_info = GhPythonScript(process=ghpython_script_4.process, PG1000_width=panel_3, PG500_width=panel_4)  # -> out, beam_ids, lengths, start_lengths, end_lengths, gripper_types, clamps; disabled
# ---------- beam_pickup_info: Python ----------
beam_ids = list(process.assembly.sequence)
lengths = [process.assembly.beam(beam_id).length for beam_id in process.assembly.sequence]
gripper_types = [process.assembly.get_beam_attribute(beam_id, 'gripper_type') for beam_id in process.assembly.sequence]
clamps = []
start_lengths = []
end_lengths = []

for beam_id in process.assembly.sequence:
    dist_from_start = process.assembly.get_beam_attribute(beam_id, 'gripper_grasp_dist_from_start')
    length = process.assembly.beam(beam_id).length
    gripper_type = process.assembly.get_beam_attribute(beam_id, 'gripper_type')
    if gripper_type == "PG1000":
        gripper_width = PG1000_width
    elif gripper_type == "PG500":
        gripper_width = PG500_width
    else:
        raise ValueError()
    start_lengths.append(dist_from_start - gripper_width / 2)
    end_lengths.append(length - dist_from_start - gripper_width / 2)
    
    if len(process.assembly.get_joint_ids_of_beam_clamps(beam_id)) > 0:
        actions = process.get_action_by_beam_id(beam_id)
        for action in actions:
            if action.__class__.__name__ == "BeamPlacementWithClampsAction":
                clamps.append(' ,'.join(sorted(action.clamp_ids)))
                break
    else:
        clamps.append(" ")
# ---------- end beam_pickup_info ----------
panel_5 = Panel(beam_pickup_info.clamps)  # disabled

# ----
# Jump Check (Entire File)
jump_within_movement = GhPythonScript(process=ghpython_script_4.process, dist_threshold=prismatic_joint_tolerance_m, angle_threshold=rad)  # -> out, avg_jump, max_jump, problems
# ---------- jump_within_movement: Python ----------
from integral_timber_joints.process import RoboticFreeMovement, RoboticLinearMovement, RoboticMovement
problems = []
diffs = [[],[],[],[],[],[],[],[],[]]
# threshold

for action in process.actions:
    for movement in action.movements:
        if not isinstance(movement, RoboticMovement) or (movement.trajectory is None):
            continue
        t = movement.trajectory
        # Joint values of the first point
        last_values = list(t.points[0].values())
        for p in range(1, len(t.points)-1):
            # Joint values of this point
            values = list(t.points[p].values())
            joint_types = t.points[0].joint_types
            for i in range (9):
                diff = abs(last_values[i] - values[i])
                diffs[i].append(diff)
                threshold = dist_threshold if joint_types[i] == 2 else angle_threshold
                if diff > threshold:
                    problems.append ("Jump at seq #%i, %s, Point %i, Joint %s: Jump = %.4g (threshold=%s)" % (action.seq_n, movement.movement_id, p, t.joint_names[i], diff, threshold))
            last_values = values
            
avg_jump = [sum(diffs[i]) / len(diffs[i]) for i in range(9)]
max_jump = [max(diffs[i]) for i in range(9)]
# ---------- end jump_within_movement ----------
jump_across_all_movements = GhPythonScript(process=ghpython_script_4.process, dist_threshold=prismatic_joint_tolerance_m, angle_threshold=rad)  # -> out, avg_jump, max_jump, problems
# ---------- jump_across_all_movements: Python ----------
from integral_timber_joints.process import RoboticFreeMovement, RoboticLinearMovement, RoboticMovement
problems = []
diffs = [[],[],[],[],[],[],[],[],[]]

last_values = None
for action in process.actions:
    for movement in action.movements:
        if not isinstance(movement, RoboticMovement):
            continue
        if (movement.trajectory is None):
            problems.append ("Skipping seq #%s, %s because no trajectory" % (action.seq_n, movement.movement_id))
            continue
        t = movement.trajectory
        for p in range(len(t.points)):
           values = list(t.points[p].values())
           joint_types = t.points[0].joint_types
           # Compare with last_values 
           if last_values is not None:
                for i in range (9):
                    diff = abs(last_values[i] - values[i])
                    diffs[i].append(diff)
                    threshold = dist_threshold if joint_types[i] == 2 else angle_threshold
                    if diff > threshold:
                        problems.append ("Jump at seq #%i, %s, Point %i, Joint %s: Jump = %.4g (threshold=%s)" % (action.seq_n, movement.movement_id, p, t.joint_names[i], diff, threshold))
           # Store point for next loop
           last_values = values
            
avg_jump = [sum(diffs[i]) / len(diffs[i]) for i in range(9)]
max_jump = [max(diffs[i]) for i in range(9)]
# ---------- end jump_across_all_movements ----------
panel_6 = Panel(jump_within_movement.problems)
panel_7 = Panel(jump_across_all_movements.problems)
avg = Panel(jump_across_all_movements.avg_jump)
avg_2 = Panel(jump_within_movement.avg_jump)
max = Panel(jump_across_all_movements.max_jump)
max_2 = Panel(jump_within_movement.max_jump)

gate = StreamGate(Stream=ghpython_script_4.process, Gate=perform_polyline_check)  # -> Target0, Target1; disabled
gate_2 = StreamGate(Stream=robot, Gate=perform_polyline_check)  # -> Target0, Target1; disabled

series = Series(Start=Slider(52, range=0..100), Step=1, Count=Slider(30, range=0..30))
merge = Merge(
    Data1=Slider(0, range=0..100),
    Data2=Slider(1, range=0..100),
    Data3=series,
    Data4=Slider(82, range=0..100),
    Data5=Slider(83, range=0..100))  # -> flatten(Result)

# ----
# Main Control
# Beam Pickup: 0 clamp - Movement 6
# 1 clamps - Movement 14
# 2 clamps - Movement 22
filter = ValueList({"All": None, "RoboticFreeMovement", "RoboticLinearMovement"}, selected="RoboticFreeMovement")
next_movement_hold_1_sec = Button()
seq_n = Slider(31, range=0..40)
trajectorypoint = Slider(0, range=0..129)
movement_number_not_meaningful_if_sorted = Slider(1, range=0..10)

movements = GhPythonScript(
    process=ghpython_script_4.process,
    filter_seq_n=seq_n,
    filter_only_with_traj=Toggle(True),
    filter_by_movement_type=filter)  # -> out, movements, movement_descriptions, movement_ids, beam_ids, trajectory, trajectory_points; inputs filter_seq_n: Int32, filter_only_with_traj: Boolean
# ---------- movements: Python ----------
from integral_timber_joints.process import RoboticFreeMovement, RoboticLinearMovement, RoboticMovement

movement_descriptions = []
movement_ids = []
trajectory = []
trajectory_points = []
beam_ids = process.assembly.sequence

for action in process.actions:
    
    if (filter_seq_n is not None) and filter_seq_n != action.seq_n:
        continue
    for movement in action.movements:
        #print(movement.__class__.__name__)
        if filter_only_with_traj and not isinstance(movement, RoboticMovement):
            continue
        if filter_only_with_traj and (movement.trajectory is None):
            continue
        if filter_by_movement_type is not None and (movement.__class__.__name__ != filter_by_movement_type):
            continue

        speed_type = (" ; " + movement.speed_type) if hasattr(movement, 'speed_type') else ""
        movement_descriptions.append(movement.movement_id + ": " + movement.tag + speed_type)
        movement_ids.append(movement.movement_id)
        if isinstance(movement, RoboticMovement):
            trajectory.append(movement.trajectory)
            if movement.trajectory is not None:
                trajectory_points.append(len(movement.trajectory.points))
            else:
                trajectory_points.append(0)
        else:
            trajectory.append(None)
            trajectory_points.append(0)
# ---------- end movements ----------
panel_8 = Panel(movements.movement_descriptions)

# ----
# Smoothing Experiment
number_slider = Slider(10, range=0..10)  # disabled
number_slider_2 = Slider(1, range=0..1)  # disabled
item = ListItem(List=movements.trajectory, Index=movement_number_not_meaningful_if_sorted, Wrap=True)  # disabled
python = GhPythonScript(trajectory=item, iteration=number_slider, amount=number_slider_2)  # -> out, trajectory_out; inputs iteration: Int32; disabled
# ---------- python: Python ----------
from copy import deepcopy

trajectory = deepcopy(trajectory)

print (trajectory.points[10].values)

def smooth(trajectory, percentage):
    for i in range (1, len(trajectory.points)- 1):
        for j in range(9):
            value = trajectory.points[i].values[j]
            average = ( trajectory.points[i - 1].values[j] + trajectory.points[i + 1].values[j] ) / 2
            trajectory.points[i].values[j] = value * (1-percentage) + average * percentage
    return trajectory

for i in range(iteration):
    trajectory = smooth(trajectory, amount)
    print (trajectory.points[10].values)

trajectory_out = trajectory
# ---------- end python ----------

item_2 = ListItem(List=movements.movement_ids, Index=movement_number_not_meaningful_if_sorted, Wrap=True)
addition = Addition(A=movement_number_not_meaningful_if_sorted, B=1)
movement_id = Text(item_2)

trajectory = GhPythonScript(robot=robot, process=ghpython_script_4.process, movement_id=movement_id, trajectory=python.trajectory_out)  # -> out, start_t0cp_frame, attached_toolchanger_mesh_at_start, attached_tool_mesh_at_start, attached_beam_mesh_at_start, graft(robot_t0cp_frames); disabled
# ---------- trajectory: Python ----------
from integral_timber_joints.process import RoboticFreeMovement, RoboticLinearMovement, RoboticMovement
from compas.geometry import Frame
from compas.geometry import Transformation, Frame, Scale
from compas_ghpython import draw_frame
from copy import deepcopy
from compas_ghpython.artists import RobotModelArtist
from compas_ghpython.artists import MeshArtist

movement = process.get_movement_by_movement_id(movement_id)
start_state = process.get_movement_start_state(movement)

robot_11_joints= ['bridge1_joint_EA_X', 'robot11_joint_EA_Y', 'robot11_joint_EA_Z', 'robot11_joint_1', 'robot11_joint_2', 'robot11_joint_3', 'robot11_joint_4', 'robot11_joint_5', 'robot11_joint_6']

full_config = deepcopy(process.robot_initial_config)

robot_t0cp_frames = []

if hasattr(movement,'trajectory'):
    if trajectory is None:
        trajectory = movement.trajectory
    else:
        print ("Using external trajectory")
    
    # Get robotic configutation at traj point
    for i, point in enumerate(trajectory.points):
        point.joint_names = trajectory.joint_names
        full_config.merge(point)

        #robot_t0cp_frame = movement.path_from_link['robot11_tool0'][i]
        robot_t0cp_frame = robot.forward_kinematics(full_config, process.robot_group_name)
        T = Scale.from_factors([1000] * 3)
        robot_t0cp_frame = robot_t0cp_frame.transformed(T)
        robot_t0cp_frames.append(draw_frame(robot_t0cp_frame))
        if i == 0 :
            start_t0cp_frame = draw_frame(robot_t0cp_frame)
    
    # Get tool changer
    toolchanger = process.robot_toolchanger
    toolchanger.set_state(start_state['tool_changer'])
    artist = RobotModelArtist(toolchanger)
    attached_toolchanger_mesh_at_start = toolchanger.draw_visual(artist)


# Get attached tool
for id, state in start_state.items():
    if id in process.tool_ids:
        if state.attached_to_robot:
            attached_tool = process.tool(id)
            attached_tool.set_state(state)
            artist = RobotModelArtist(attached_tool)
            attached_tool_mesh_at_start = attached_tool.draw_visual(artist)
            break
            
# Get attached beam
for id, state in start_state.items():
    if id in process.assembly.beam_ids():
        if state.attached_to_robot:
            beam = process.assembly.beam(id)
            beam.set_state(state)
            T = Transformation.from_frame_to_frame(beam.frame, beam.current_frame)
            mesh = beam.cached_mesh.transformed(T)
            artist = MeshArtist(mesh)
            attached_beam_mesh_at_start = artist.draw()
            break
# ---------- end trajectory ----------
demesh = DeconstructMesh(Mesh=trajectory.attached_toolchanger_mesh_at_start)  # -> flatten(Vertices), Faces, Colours, Normals; disabled
demesh_2 = DeconstructMesh(Mesh=trajectory.attached_tool_mesh_at_start)  # -> flatten(Vertices), Faces, Colours, Normals; disabled
demesh_3 = DeconstructMesh(Mesh=trajectory.attached_beam_mesh_at_start)  # -> flatten(Vertices), Faces, Colours, Normals; disabled
duppt = RemoveDuplicatePts(Points=demesh.Vertices, Tolerance=0.01)  # disabled
duppt_2 = RemoveDuplicatePts(Points=demesh_2.Vertices, Tolerance=0.01)  # disabled
duppt_3 = RemoveDuplicatePts(Points=demesh_3.Vertices, Tolerance=0.01)  # disabled
orient = Orient(Geometry=graft(duppt), Source=trajectory.start_t0cp_frame, Target=flatten(trajectory.robot_t0cp_frames))  # -> Geometry, Transform; disabled
orient_2 = Orient(Geometry=graft(duppt_3), Source=trajectory.start_t0cp_frame, Target=flatten(trajectory.robot_t0cp_frames))  # -> Geometry, Transform; disabled
orient_3 = Orient(Geometry=graft(duppt_2), Source=trajectory.start_t0cp_frame, Target=flatten(trajectory.robot_t0cp_frames))  # -> Geometry, Transform; disabled
pline = PolyLine(Vertices=orient.Geometry, Closed=False)  # disabled
pline_2 = PolyLine(Vertices=orient_3.Geometry, Closed=False)  # disabled
pline_3 = PolyLine(Vertices=orient_2.Geometry, Closed=False)  # disabled

filter_2 = StreamFilter(Gate=next_movement_hold_1_sec, Stream0=movement_number_not_meaningful_if_sorted, Stream1=addition)

item_3 = ListItem(List=movements.trajectory_points, Index=movement_number_not_meaningful_if_sorted, Wrap=True)
lng = ListLength(List=movements.movement_ids)
number_of_points = Panel(item_3)
subtraction = Subtraction(A=lng, B=1)
dam = DataDam(DataA=filter_2, BufferDelay=20000000, BufferMode=2)
subtraction_2 = Subtraction(A=number_of_points, B=1)
selobj = GetSelectedObjects(AllObjects_Object=movement_number_not_meaningful_if_sorted)  # -> ComponentObjects, ParamObjects, OtherObjects
dom = ConstructDomain(DomainStart=0, DomainEnd=subtraction)
set_slider = SetSliderProperties(Slider=selobj.ParamObjects, Value=dam, Range=dom)

item_4 = ListItem(List=movements.movement_descriptions, Index=movement_number_not_meaningful_if_sorted, Wrap=True)

selobj_2 = GetSelectedObjects(AllObjects_Object=trajectorypoint)  # -> ComponentObjects, ParamObjects, OtherObjects
dom_2 = ConstructDomain(DomainStart=0, DomainEnd=subtraction_2)
set_slider_2 = SetSliderProperties(Slider=selobj_2.ParamObjects, Value=Slider(0, range=0..100), Range=dom_2)

trajectory_2 = GhPythonScript(robot=robot, process=ghpython_script_4.process, movement_id=movement_id, trajectory_point_n=trajectorypoint)  # -> out, trajectory, start_state, robot_t0cp_frame, attached_toolchanger, attached_tool, other_tools, attached_beam, other_beams, configuration; inputs trajectory_point_n: Int32; disabled
# ---------- trajectory_2: Python ----------
from integral_timber_joints.process import RoboticFreeMovement, RoboticLinearMovement, RoboticMovement
from compas.geometry import Frame
from compas.geometry import Transformation, Frame, Scale
from copy import deepcopy

movement = process.get_movement_by_movement_id(movement_id)
start_state = process.get_movement_start_state(movement)

robot_11_joints= ['bridge1_joint_EA_X', 'robot11_joint_EA_Y', 'robot11_joint_EA_Z', 'robot11_joint_1', 'robot11_joint_2', 'robot11_joint_3', 'robot11_joint_4', 'robot11_joint_5', 'robot11_joint_6']
#full_config = deepcopy(full_config)
full_config = deepcopy(process.robot_initial_config)
if isinstance(movement, RoboticMovement):
    # Get robotic configutation at traj point
    point = movement.trajectory.points[trajectory_point_n]
    point.joint_names = movement.trajectory.joint_names
    full_config.merge(point)
    
    # Robot FK
    robot_t0cp_frame = robot.forward_kinematics(full_config, process.robot_group_name)
    robot_t0cp_frame = Frame.from_data(robot_t0cp_frame.data)
    T = Scale.from_factors([1000] * 3)
    robot_t0cp_frame.transform(T)
else:
    # bug here hot fix
    start_state['robot'].kinematic_config.joint_names = robot_11_joints
    full_config.merge(start_state['robot'].kinematic_config)
    
    # Robot at TargetFrame
    robot_t0cp_frame = start_state['robot'].current_frame



# Get tool changer
attached_toolchanger = process.robot_toolchanger
other_tools = []
other_beams = []
# Get attached tool
for id, state in start_state.items():
    if id in process.tool_ids:
        tool_id = id
        tool = process.tool(id)
        tool.set_state(start_state[id])
        if state.attached_to_robot:
            attached_tool = tool
        else:
            other_tools.append(tool)
    
    # Get attached beam
    if id in process.assembly.beam_ids():
        beam = process.assembly.beam(id)
        beam.current_frame = state.current_frame
        if state.attached_to_robot:
            attached_beam = beam
        else:
            other_beams.append(beam)
configuration = full_config
# ---------- end trajectory_2 ----------

# ----
# Robot Visualisation
show_end_effector_frame = BooleanToggle(True)  # disabled
configurations_at_pickup = Data(trajectory_2.configuration)  # disabled
show_base_frame = BooleanToggle(False)  # disabled
show_collision = BooleanToggle(True)  # disabled
show_frames = BooleanToggle(False)  # disabled
show_visual = BooleanToggle(True)  # disabled
panel_9 = Panel("""world
x_rail
bridge1
robot11_xy_cart
robot11_base
robot11_base_link
robot11_link_1
robot11_link_2
robot11_link_3
robot11_link_4
robot11_link_5
robot11_link_6
robot12_xy_cart
robot12_base
robot12_base_link
robot12_link_1
robot12_link_2
robot12_link_3
robot12_link_4
robot12_link_5
robot12_link_6
bridge2
robot21_xy_cart
robot21_base
robot21_base_link
robot21_link_1
robot21_link_2
robot21_link_3
robot21_link_4
robot21_link_5
robot21_link_6
robot22_xy_cart
robot22_base
robot22_base_link
robot22_link_1
robot22_link_2
robot22_link_3
robot22_link_4
robot22_link_5
robot22_link_6""")  # disabled
visualize = PythonScript(
    robot=robot,
    group=panel,
    configuration=configurations_at_pickup,
    show_visual=show_visual,
    show_collision=show_collision,
    show_frames=show_frames,
    show_base_frame=show_base_frame,
    show_end_effector_frame=show_end_effector_frame)  # -> out, link_names, visual, collision, frames, ee_frame, base_frame; disabled
# ---------- visualize: Python ----------
"""Visualizes a robot.
    Inputs:
        robot: The robot
        configuration: :class:`compas_fab.robots.Configuration`
            The robot's full configuration to display.
        show_visual: bool
           Whether or not to show the robot's visual meshes.
        show_collision: bool
           Whether or not to show the robot's collision meshes.
        show_frames: bool
           Whether or not to show the robot's joint frames.
        show_base_frame: bool
           Whether or not to show the robot's base frame.
        show_end_effector_frame: bool
            Whether or not to show the robot's end-effector frame.
    Output:
        visual: The robot's visual meshes.
        collision: The robot's collision meshes.
        frames: The robot's joint frames.
        base_frame: The robot's base frame.
        ee_frame: The robot's end-effector frame.
"""
from __future__ import print_function
from compas.geometry import Frame
print (robot.group_names)
if robot and configuration:
    group = group or robot.main_group_name
    robot.update(configuration, group, visual=show_visual, collision=show_collision)
    print(robot.get_end_effector_link_name(group))
    if show_visual:
        visual = robot.artist.draw_visual()

    if show_collision:
        collision = robot.artist.draw_collision()

    if show_frames:
        axes = robot.transformed_axes(configuration, group)
        frames = robot.transformed_frames(configuration, group)

    if show_base_frame:
        frames = robot.transformed_frames(configuration, group)
        base_frame = frames[0]

    if show_end_effector_frame:
        ee_frame = robot.forward_kinematics(configuration, group)
        ee_frame = Frame.from_data(ee_frame.data)
        
        print ("End-effector", ee_frame)
link_names = []
for link in robot.model.iter_links():
    for item in getattr(link, 'visual'):
        link_names.append (link.name)
# ---------- end visualize ----------
number_slider_3 = Slider(1, range=0..1)  # disabled
filter_by_robot_link_name = Panel("""robot11_base
robot11_base_link
robot11_link_1
robot11_link_2
robot11_link_3
robot11_link_4
robot11_link_5
robot11_link_6""")  # disabled
intersection = SetIntersection(SetA=filter_by_robot_link_name, SetB=visualize.link_names)  # disabled
draw = GhPythonScript(frames=[visualize.frames, visualize.ee_frame, visualize.base_frame], scale=number_slider_3)  # -> P, V, C, W, flatten(planes); inputs frames: list; disabled
# ---------- draw: Python ----------
from System.Drawing import Color
from compas_ghpython import draw_frame

red = Color.FromArgb(255, 0, 0)
green = Color.FromArgb(0, 255, 0)
blue = Color.FromArgb(0, 0, 255)

P = []
V = []
C = []
planes = []

scale = float(scale)

for frame in frames:
    if not frame:
        continue
    plane = draw_frame(frame)
    P += [plane.Origin] * 3
    V.append(plane.XAxis * scale)
    V.append(plane.YAxis * scale)
    V.append(plane.ZAxis * scale)
    C += [red, green, blue]
    planes.append(plane)

W = 3
# ---------- end draw ----------
keysearch = KeyValueSearch(Keys=visualize.link_names, Values=visualize.visual, Search=intersection)  # disabled
keysearch_2 = KeyValueSearch(Keys=visualize.link_names, Values=visualize.collision, Search=intersection)  # disabled
python_2 = GhPythonScript(frame=visualize.ee_frame)  # -> out, plane; disabled
# ---------- python_2: Python ----------
from compas_ghpython import draw_frame
plane = draw_frame(frame)
# ---------- end python_2 ----------
geometry = Geometry(keysearch)  # disabled
geometry_2 = Geometry(keysearch_2)  # disabled
scale = Scale(Geometry=draw.P, Center=Point(0, 0, 0), Factor=1000)  # -> Geometry, Transform; disabled
scale_2 = Scale(Geometry=python_2.plane, Center=Point(0, 0, 0), Factor=1000)  # -> Geometry, Transform; disabled
scale_3 = Scale(Geometry=keysearch, Center=Point(0, 0, 0), Factor=1000)  # -> Geometry, Transform; disabled
scale_4 = Scale(Geometry=geometry_2, Center=Point(0, 0, 0), Factor=1000)  # -> Geometry, Transform; disabled
vector_display_ex = VectorDisplayEx(Point=scale.Geometry, Vector=draw.V, Colour=draw.C, Width=draw.W)  # disabled
swatch = ColourSwatch(SwatchColor=RGBA(176, 99, 99, 42))  # disabled
swatch_2 = ColourSwatch(SwatchColor=RGBA(50, 119, 168, 137))  # disabled
panel_10 = Panel(scale_2.Geometry)  # disabled
preview = CustomPreview(Geometry=scale_4.Geometry, Material=swatch)  # disabled
preview_2 = CustomPreview(Geometry=scale_3.Geometry, Material=swatch_2)  # disabled

# ----
# Tool / Beam Visualisation
robot_artist = GhPythonScript(tool_model=trajectory_2.attached_toolchanger, current_frame=trajectory_2.robot_t0cp_frame)  # -> out, visual, tcf; disabled
# ---------- robot_artist: Python ----------
from compas_ghpython.artists import RobotModelArtist
from compas_rhino.geometry import RhinoPlane
from compas.geometry import Transformation, Frame, Scale
from Rhino.Geometry import Plane


# Create a transformation for base location
if current_frame:
    if isinstance(current_frame, Plane):
        current_frame = RhinoPlane.from_geometry(current_frame).to_compas()
        print("frame converted from RhinoPlane")
    tool_model.current_frame = current_frame


artist = RobotModelArtist(tool_model)
visual = tool_model.draw_visual(artist)
tcf = tool_model.current_tcf
# ---------- end robot_artist ----------
robot_artist_2 = GhPythonScript(tool_model=trajectory_2.attached_tool, current_frame=robot_artist.tcf)  # -> out, visual, tcf; disabled
# ---------- robot_artist_2: Python ----------
from compas_ghpython.artists import RobotModelArtist
from compas_rhino.geometry import RhinoPlane
from compas.geometry import Transformation, Frame, Scale
from Rhino.Geometry import Plane


# Create a transformation for base location
if current_frame:
    if isinstance(current_frame, Plane):
        current_frame = RhinoPlane.from_geometry(current_frame).to_compas()
        print("frame converted from RhinoPlane")
    tool_model.current_frame = current_frame

    artist = RobotModelArtist(tool_model)
    visual = tool_model.draw_visual(artist)
    tcf = tool_model.current_tcf
# ---------- end robot_artist_2 ----------
beam_artist = GhPythonScript(process=ghpython_script_4.process, beam=trajectory_2.attached_beam, current_frame=robot_artist_2.tcf)  # -> out, visual; disabled
# ---------- beam_artist: Python ----------
from compas_ghpython.artists import MeshArtist
from compas_rhino.geometry import RhinoPlane
from compas.geometry import Transformation, Frame, Scale
from Rhino.Geometry import Plane


# Create a transformation for base location



if beam:
    # Beam frame
    if current_frame:
        if isinstance(current_frame, Plane):
            current_frame = RhinoPlane.from_geometry(current_frame).to_compas()
        print("frame converted from RhinoPlane")

        # Transform Beam to frame
        beam_id = beam.name
        beam_from_gripper_tcp = Transformation.from_frame(process.assembly.get_beam_attribute(beam_id, 'gripper_tcp_in_ocf'))
        world_from_gripper_tcp = Transformation.from_frame(current_frame)
        world_from_beam_final = Transformation.from_frame(beam.frame)
        beam_final_from_beam = world_from_gripper_tcp * beam_from_gripper_tcp.inverse() * world_from_beam_final.inverse()
        mesh = beam.cached_mesh.transformed( beam_final_from_beam )
    else:
        world_from_beam_final = Transformation.from_frame(beam.frame)
        T = Transformation.from_frame(beam.current_frame)
        mesh = beam.cached_mesh.transformed( T * world_from_beam_final.inverse())

    artist = MeshArtist(mesh)
    visual = artist.draw()
# ---------- end beam_artist ----------
panel_11 = Panel("Attached")  # disabled
panel_12 = Panel("Detached")  # disabled
beam_artist_2 = GhPythonScript(process=ghpython_script_4.process, beam=trajectory_2.other_beams)  # -> out, visual; disabled
# ---------- beam_artist_2: Python ----------
from compas_ghpython.artists import MeshArtist
from compas_rhino.geometry import RhinoPlane
from compas.geometry import Transformation, Frame, Scale
from Rhino.Geometry import Plane


# Create a transformation for base location



if beam:
    # Beam frame
    if current_frame:
        if isinstance(current_frame, Plane):
            current_frame = RhinoPlane.from_geometry(current_frame).to_compas()
        print("frame converted from RhinoPlane")

        # Transform Beam to frame
        beam_id = beam.name
        beam_from_gripper_tcp = Transformation.from_frame(process.assembly.get_beam_attribute(beam_id, 'gripper_tcp_in_ocf'))
        world_from_gripper_tcp = Transformation.from_frame(current_frame)
        world_from_beam_final = Transformation.from_frame(beam.frame)
        beam_final_from_beam = world_from_gripper_tcp * beam_from_gripper_tcp.inverse() * world_from_beam_final.inverse()
        mesh = beam.cached_mesh.transformed( beam_final_from_beam )
    else:
        world_from_beam_final = Transformation.from_frame(beam.frame)
        T = Transformation.from_frame(beam.current_frame)
        mesh = beam.cached_mesh.transformed( T * world_from_beam_final.inverse())

artist = MeshArtist(mesh)
visual = artist.draw()
# ---------- end beam_artist_2 ----------
robot_artist_3 = GhPythonScript(tool_model=trajectory_2.other_tools)  # -> out, visual, tcf; disabled
# ---------- robot_artist_3: Python ----------
from compas_ghpython.artists import RobotModelArtist
from compas_rhino.geometry import RhinoPlane
from compas.geometry import Transformation, Frame, Scale
from Rhino.Geometry import Plane


# Create a transformation for base location
if current_frame:
    if isinstance(current_frame, Plane):
        current_frame = RhinoPlane.from_geometry(current_frame).to_compas()
        print("frame converted from RhinoPlane")
    tool_model.current_frame = current_frame

artist = RobotModelArtist(tool_model)
visual = tool_model.draw_visual(artist)
tcf = tool_model.current_tcf
# ---------- end robot_artist_3 ----------
panel_13 = Panel("Tool Changer")  # disabled
panel_14 = Panel("Tool")  # disabled
panel_15 = Panel("Beam")  # disabled

attached_tool = CustomPreview(Geometry=[robot_artist.visual, robot_artist_2.visual], Material=ColourSwatch(SwatchColor=RGBA(168, 117, 50, 137)))
attached_beam = CustomPreview(Geometry=beam_artist.visual, Material=ColourSwatch(SwatchColor=RGBA(121, 168, 50, 137)))
other_beams = CustomPreview(Geometry=beam_artist_2.visual, Material=ColourSwatch(SwatchColor=RGBA(97, 186, 127, 137)))
other_tools = CustomPreview(Geometry=robot_artist_3.visual, Material=ColourSwatch(SwatchColor=RGBA(168, 117, 50, 137)))

# ----
# Configuration (at point)
python_3 = GhPythonScript(configuration=trajectory_2.configuration)  # -> out; disabled
# ---------- python_3: Python ----------
print (configuration)
# ---------- end python_3 ----------
panel_16 = Panel(python_3)  # disabled

# ----
# Stationary Meshes for Polyline Check
trajectory_3 = GhPythonScript(robot=gate_2.Target1, process=gate.Target1, movement_id=movement_id, trajectory_point_n=0)  # -> out, trajectory, start_state, robot_t0cp_frame, attached_toolchanger, attached_tool, other_tools, attached_beam, other_beams, configuration; inputs trajectory_point_n: Int32; disabled; same code as trajectory_2
environment_mesh = GhPythonScript(process=ghpython_script_4.process)  # -> out, collision_meshes; disabled
# ---------- environment_mesh: Python ----------
from compas_ghpython.artists import MeshArtist
collision_meshes = []

for env_id in process.environment_models:
    env = process.environment_model(env_id)
    artist = MeshArtist(env)
    visual = artist.draw()
    collision_meshes.append(visual)
# ---------- end environment_mesh ----------
beam_artist_3 = GhPythonScript(process=ghpython_script_4.process, beam=trajectory_3.other_beams)  # -> out, visual; disabled; same code as beam_artist_2
robot_artist_4 = GhPythonScript(tool_model=trajectory_3.other_tools)  # -> out, visual, tcf; disabled; same code as robot_artist_3
stationary_beams = Geometry(flatten(beam_artist_3.visual))  # disabled
stationary_tools = Geometry(flatten(robot_artist_4.visual))  # disabled
environment = Geometry(flatten(environment_mesh.collision_meshes))  # disabled

# ----
# Attached Toolchanger / Tool / Beam Polylines
trajectory_4 = GhPythonScript(robot=gate_2.Target1, process=gate.Target1, movement_id=movement_id)  # -> out, start_t0cp_frame, attached_toolchanger_mesh_at_start, attached_tool_mesh_at_start, attached_beam_mesh_at_start, graft(robot_t0cp_frames); disabled
# ---------- trajectory_4: Python ----------
from integral_timber_joints.process import RoboticFreeMovement, RoboticLinearMovement, RoboticMovement
from compas.geometry import Frame
from compas.geometry import Transformation, Frame, Scale
from compas_ghpython import draw_frame
from copy import deepcopy
from compas_ghpython.artists import RobotModelArtist
from compas_ghpython.artists import MeshArtist

movement = process.get_movement_by_movement_id(movement_id)
start_state = process.get_movement_start_state(movement)

robot_11_joints= ['bridge1_joint_EA_X', 'robot11_joint_EA_Y', 'robot11_joint_EA_Z', 'robot11_joint_1', 'robot11_joint_2', 'robot11_joint_3', 'robot11_joint_4', 'robot11_joint_5', 'robot11_joint_6']

full_config = deepcopy(process.robot_initial_config)

robot_t0cp_frames = []

if hasattr(movement,'trajectory'):
    # Get robotic configutation at traj point
    for i, point in enumerate(movement.trajectory.points):
        point.joint_names = movement.trajectory.joint_names
        full_config.merge(point)

        robot_t0cp_frame = movement.path_from_link['robot11_tool0'][i]
        T = Scale.from_factors([1000] * 3)
        robot_t0cp_frame = robot_t0cp_frame.transformed(T)
        robot_t0cp_frames.append(draw_frame(robot_t0cp_frame))
        if i == 0 :
            start_t0cp_frame = draw_frame(robot_t0cp_frame)
    
    # Get tool changer
    toolchanger = process.robot_toolchanger
    toolchanger.set_state(start_state['tool_changer'])
    artist = RobotModelArtist(toolchanger)
    attached_toolchanger_mesh_at_start = toolchanger.draw_visual(artist)


# Get attached tool
for id, state in start_state.items():
    if id in process.tool_ids:
        if state.attached_to_robot:
            attached_tool = process.tool(id)
            attached_tool.set_state(state)
            artist = RobotModelArtist(attached_tool)
            attached_tool_mesh_at_start = attached_tool.draw_visual(artist)
            break
            
# Get attached beam
for id, state in start_state.items():
    if id in process.assembly.beam_ids():
        if state.attached_to_robot:
            beam = process.assembly.beam(id)
            beam.set_state(state)
            T = Transformation.from_frame_to_frame(beam.frame, beam.current_frame)
            mesh = beam.cached_mesh.transformed(T)
            artist = MeshArtist(mesh)
            attached_beam_mesh_at_start = artist.draw()
            break
# ---------- end trajectory_4 ----------
demesh_4 = DeconstructMesh(Mesh=trajectory_4.attached_toolchanger_mesh_at_start)  # -> flatten(Vertices), Faces, Colours, Normals; disabled
demesh_5 = DeconstructMesh(Mesh=trajectory_4.attached_tool_mesh_at_start)  # -> flatten(Vertices), Faces, Colours, Normals; disabled
demesh_6 = DeconstructMesh(Mesh=trajectory_4.attached_beam_mesh_at_start)  # -> flatten(Vertices), Faces, Colours, Normals; disabled
duppt_4 = RemoveDuplicatePts(Points=demesh_4.Vertices, Tolerance=0.01)  # disabled
duppt_5 = RemoveDuplicatePts(Points=demesh_5.Vertices, Tolerance=0.01)  # disabled
duppt_6 = RemoveDuplicatePts(Points=demesh_6.Vertices, Tolerance=0.01)  # disabled
orient_4 = Orient(Geometry=graft(duppt_4), Source=trajectory_4.start_t0cp_frame, Target=flatten(trajectory_4.robot_t0cp_frames))  # -> Geometry, Transform; disabled
orient_5 = Orient(Geometry=graft(duppt_6), Source=trajectory_4.start_t0cp_frame, Target=flatten(trajectory_4.robot_t0cp_frames))  # -> Geometry, Transform; disabled
orient_6 = Orient(Geometry=graft(duppt_5), Source=trajectory_4.start_t0cp_frame, Target=flatten(trajectory_4.robot_t0cp_frames))  # -> Geometry, Transform; disabled
pline_4 = PolyLine(Vertices=orient_4.Geometry, Closed=False)  # disabled
pline_5 = PolyLine(Vertices=orient_6.Geometry, Closed=False)  # disabled
pline_6 = PolyLine(Vertices=orient_5.Geometry, Closed=False)  # disabled
crv = Curve(flatten([pline_4, pline_5, pline_6]))  # disabled
null = NullItem(Item=crv)  # -> NullFlags, InvalidFlags, Description; disabled
cull = CullPattern(List=crv, CullPattern=invert(null.NullFlags))  # disabled
crv_2 = Curve(flatten(cull))  # disabled

# ----
# Polyline Collision
colom = CollisionOneMany(Collider=crv_2, Obstacles=[stationary_tools, stationary_beams, environment])  # -> Collision, Index; disabled
ma = MassAddition(Input=colom.Collision)  # -> Result, PartialResults; disabled
cull_2 = CullPattern(List=crv_2, CullPattern=invert(colom.Collision))  # disabled
cull_3 = CullPattern(List=crv_2, CullPattern=colom.Collision)  # disabled
swatch_3 = ColourSwatch(SwatchColor=RGB(222, 24, 24))  # disabled
swatch_4 = ColourSwatch(SwatchColor=RGBA(99, 155, 176, 42))  # disabled
preview_3 = CustomPreview(Geometry=cull_3, Material=swatch_3)  # disabled
preview_4 = CustomPreview(Geometry=cull_2, Material=swatch_4)  # disabled

chosen_movement = Panel(item_4)
item_5 = ListItem(List=movements.beam_ids, Index=seq_n, Wrap=True)
of_polyline_collisions = Panel(ma.Result)
beam_id = Panel(item_5)
